# Grasshopper definition 001_MagicSquare.gh (Grasshopper 1.0.7)
# plug-ins: RhinoCodePluginGH

# PARAMETRIC
magic_squares = Script(x1=Slider(7, range=0..10))  # -> out, A; inputs x1: Int32
# ---------- magic_squares: C# ----------
// Grasshopper Script Instance
using System;
using System.Collections;
using System.Collections.Generic;
using System.Drawing;

using Rhino;
using Rhino.Geometry;

using Grasshopper;
using Grasshopper.Kernel;
using Grasshopper.Kernel.Data;
using Grasshopper.Kernel.Types;

public class Script_Instance : GH_ScriptInstance
{
  private void RunScript(int x1, object y, out object A)
  {
    // Define the magic square values
    int[,] magicSquare = new int[,]
    {
      {x1, 12, 1, 14},
      {2, 13, 8, 11},
      {16, 3, 10, 5},
      {9, 6, 15, 4}
    };

    // Define the scale for the geometry
    double scale = 1.0;

    // List to hold all geometry
    List<Box> boxes = new List<Box>();

    // Iterate over each value in the magic square
    for(int i = 0; i < magicSquare.GetLength(0); i++)
    {
      for(int j = 0; j < magicSquare.GetLength(1); j++)
      {
        // Create a point at the i,j location
        Point3d basePoint = new Point3d(i * scale, j * scale, 0);

        // Use the magic square value as the height of the box
        double height = magicSquare[i,j] * scale;

        // Create a box from the base point with the specified height
        Box box = new Box(Plane.WorldXY, new Interval(0, scale), new Interval(0, scale), new Interval(0, height));
        box.Transform(Transform.Translation((Vector3d) basePoint));

        // Add the box to the list of geometry
        boxes.Add(box);
      }
    }

    // Output the boxes
    A = boxes;
  }

  // <Custom additional code> 
}
# ---------- end magic_squares ----------
# Magic Squares
# HARD CODED
magic_squares_2 = Script()  # -> out, A; disabled
# ---------- magic_squares_2: C# ----------
// Grasshopper Script Instance
using System;
using System.Collections;
using System.Collections.Generic;
using System.Drawing;

using Rhino;
using Rhino.Geometry;

using Grasshopper;
using Grasshopper.Kernel;
using Grasshopper.Kernel.Data;
using Grasshopper.Kernel.Types;

//Grasshopper Script Instance
//#! csharp
using System;
using System.Collections.Generic;
using System.Drawing;
using Rhino;
using Rhino.Geometry;
using Grasshopper;
using Grasshopper.Kernel;
using Grasshopper.Kernel.Data;
using Grasshopper.Kernel.Types;

public class Script_Instance : GH_ScriptInstance
{
  private void RunScript(object x, object y, out object A)
  {
    // Define the magic square values
    int[,] magicSquare = new int[,]
    {
      {7, 12, 1, 14},
      {2, 13, 8, 11},
      {16, 3, 10, 5},
      {9, 6, 15, 4}
    };

    // Define the scale for the geometry
    double scale = 1.0;

    // List to hold all geometry
    List<Box> boxes = new List<Box>();

    // Iterate over each value in the magic square
    for(int i = 0; i < magicSquare.GetLength(0); i++)
    {
      for(int j = 0; j < magicSquare.GetLength(1); j++)
      {
        // Create a point at the i,j location
        Point3d basePoint = new Point3d(i * scale, j * scale, 0);

        // Use the magic square value as the height of the box
        double height = magicSquare[i,j] * scale;

        // Create a box from the base point with the specified height
        Box box = new Box(Plane.WorldXY, new Interval(0, scale), new Interval(0, scale), new Interval(0, height));
        box.Transform(Transform.Translation((Vector3d) basePoint));

        // Add the box to the list of geometry
        boxes.Add(box);
      }
    }

    // Output the boxes
    A = boxes;
  }

  // <Custom additional code> 
}
# ---------- end magic_squares_2 ----------
panel = Panel(magic_squares.A)
panel_2 = Panel(magic_squares.out)
panel_3 = Panel(magic_squares_2.A)  # disabled
panel_4 = Panel(magic_squares_2.out)  # disabled
