# Grasshopper definition 002_Bernoulli_principle.gh (Grasshopper 1.0.7)
# plug-ins: RhinoCodePluginGH

# PARAMETRIC
bernoulli_s_principle = Script(
    dia1=Slider(9.77, range=0..10),
    dia2=Slider(4.81, range=0..10),
    len1=Slider(5.61, range=0..10),
    len2=Slider(9.21, range=0..10))  # -> out, A; inputs dia1: Double, dia2: Double, len1: Double, len2: Double
# ---------- bernoulli_s_principle: C# ----------
// Grasshopper Script Instance
using System;
using System.Collections;
using System.Collections.Generic;
using System.Drawing;

using Rhino;
using Rhino.Geometry;

using Grasshopper;
using Grasshopper.Kernel;
using Grasshopper.Kernel.Data;
using Grasshopper.Kernel.Types;

//Grasshopper Script Instance
//#! csharp
using System;
using System.Collections.Generic;
using System.Drawing;

using Rhino;
using Rhino.Geometry;

using Grasshopper;
using Grasshopper.Kernel;
using Grasshopper.Kernel.Data;
using Grasshopper.Kernel.Types;

public class Script_Instance : GH_ScriptInstance
{
  private void RunScript(
	double dia1,
	double dia2,
	double len1,
	double len2,
	out object A)
  {
    // Example parameter values, these would be based on your actual data
    double pipeDiameter1 = dia1; // Diameter of the first pipe
    double pipeDiameter2 = dia2; // Diameter of the second pipe
    double pipeLength1 = len1; // Length of the first pipe
    double pipeLength2 = len2; // Length of the second pipe
    Point3d startPoint = new Point3d(0, 0, 0); // Starting point of the pipe

    // Create the first pipe
    Cylinder cylinder1 = new Cylinder(new Circle(Plane.WorldXY, pipeDiameter1 / 2), pipeLength1);
    Brep pipe1 = cylinder1.ToBrep(true, true);

    // Calculate the end point of the first pipe and start point of the second
    Point3d endPoint = startPoint + new Vector3d(0, 0, pipeLength1);

    // Create the second pipe
    Cylinder cylinder2 = new Cylinder(new Circle(new Plane(endPoint, Vector3d.ZAxis), pipeDiameter2 / 2), pipeLength2);
    Brep pipe2 = cylinder2.ToBrep(true, true);

    // Debugging: Print if the pipes were created successfully
    if (pipe1 != null && pipe2 != null)
    {
      Print("Both pipes were created successfully.");
    }
    else
    {
      Print("Pipe creation failed.");
    }

    // Merge the two pipe geometries
    Brep[] breps = Brep.CreateBooleanUnion(new Brep[] { pipe1, pipe2 }, RhinoDoc.ActiveDoc.ModelAbsoluteTolerance);

    // Debugging: Check if boolean union succeeded
    if (breps != null && breps.Length > 0)
    {
      Print("Boolean union succeeded.");
      A = breps[0];
    }
    else
    {
      Print("Boolean union failed or no resulting geometry.");
      A = null;
    }
  }

  // Additional Declarations
  public override void BeforeRunScript()
  {
    // Use this method to set up any data structures that would be used in RunScript
  }
}
# ---------- end bernoulli_s_principle ----------
# Bernoulli's principle
# HARD CODED
bernoulli_s_principle_2 = Script()  # -> out, A; disabled
# ---------- bernoulli_s_principle_2: C# ----------
// Grasshopper Script Instance
using System;
using System.Collections;
using System.Collections.Generic;
using System.Drawing;

using Rhino;
using Rhino.Geometry;

using Grasshopper;
using Grasshopper.Kernel;
using Grasshopper.Kernel.Data;
using Grasshopper.Kernel.Types;

//Grasshopper Script Instance
//#! csharp
using System;
using System.Collections.Generic;
using System.Drawing;

using Rhino;
using Rhino.Geometry;

using Grasshopper;
using Grasshopper.Kernel;
using Grasshopper.Kernel.Data;
using Grasshopper.Kernel.Types;

public class Script_Instance : GH_ScriptInstance
{
  private void RunScript(object x, object y, out object A)
  {
    // Example parameter values, these would be based on your actual data
    double pipeDiameter1 = 10.0; // Diameter of the first pipe
    double pipeDiameter2 = 5.0; // Diameter of the second pipe
    double pipeLength1 = 30.0; // Length of the first pipe
    double pipeLength2 = 30.0; // Length of the second pipe
    Point3d startPoint = new Point3d(0, 0, 0); // Starting point of the pipe

    // Create the first pipe
    Cylinder cylinder1 = new Cylinder(new Circle(Plane.WorldXY, pipeDiameter1 / 2), pipeLength1);
    Brep pipe1 = cylinder1.ToBrep(true, true);

    // Calculate the end point of the first pipe and start point of the second
    Point3d endPoint = new Point3d(0, 0, pipeLength1);

    // Create the second pipe
    Cylinder cylinder2 = new Cylinder(new Circle(new Plane(endPoint, Vector3d.ZAxis), pipeDiameter2 / 2), pipeLength2);
    Brep pipe2 = cylinder2.ToBrep(true, true);

    // Merge the two pipe geometries
    Brep[] breps = Brep.CreateBooleanUnion(new Brep[]{pipe1, pipe2}, RhinoDoc.ActiveDoc.ModelAbsoluteTolerance);

    // Set the output
    if (breps != null && breps.Length > 0)
    {
      A = breps[0];
    }
    else
    {
      A = null;
    }
  }

  // <Custom additional code> 
}
# ---------- end bernoulli_s_principle_2 ----------
panel = Panel(bernoulli_s_principle_2.A)  # disabled
panel_2 = Panel(bernoulli_s_principle_2.out)  # disabled
panel_3 = Panel(bernoulli_s_principle.out)
panel_4 = Panel(bernoulli_s_principle.A)
