# Grasshopper definition 003_NueralNetwork.gh (Grasshopper 1.0.7)
# plug-ins: RhinoCodePluginGH

# Nueral
# Network
# HARD CODED
bernoulli_s_principle = Script()  # -> out, A
# ---------- bernoulli_s_principle: C# ----------
// Grasshopper Script Instance
using System;
using System.Collections;
using System.Collections.Generic;
using System.Drawing;

using Rhino;
using Rhino.Geometry;

using Grasshopper;
using Grasshopper.Kernel;
using Grasshopper.Kernel.Data;
using Grasshopper.Kernel.Types;

public class Script_Instance : GH_ScriptInstance
{
  /* 
    Members:
      RhinoDoc RhinoDocument
      GH_Document GrasshopperDocument
      IGH_Component Component
      int Iteration

    Methods (Virtual & overridable):
      Print(string text)
      Print(string format, params object[] args)
      Reflect(object obj)
      Reflect(object obj, string method_name)
  */
  
  private void RunScript(object x, object y, out object A)
  {
    // Initialize a list to hold all the geometry
    List<GeometryBase> geometries = new List<GeometryBase>();

    // Define the number of layers and the number of neurons in each layer
    int[] neuronsPerLayer = {3, 4, 4, 2}; // Example configuration for the number of neurons per layer
    double neuronRadius = 0.5; // The radius of each neuron sphere
    double layerDistance = 5.0; // The distance between each layer

    // Create the neurons
    for (int i = 0; i < neuronsPerLayer.Length; i++)
    {
      for (int j = 0; j < neuronsPerLayer[i]; j++)
      {
        Point3d center = new Point3d(i * layerDistance, j * (2 * neuronRadius + 1) - neuronsPerLayer[i], 0);
        Sphere neuron = new Sphere(center, neuronRadius);
        geometries.Add(neuron.ToNurbsSurface());
      }
    }

    // Create the connections
    for (int i = 0; i < neuronsPerLayer.Length - 1; i++)
    {
      for (int j = 0; j < neuronsPerLayer[i]; j++)
      {
        for (int k = 0; k < neuronsPerLayer[i + 1]; k++)
        {
          Point3d start = new Point3d(i * layerDistance, j * (2 * neuronRadius + 1) - neuronsPerLayer[i], 0);
          Point3d end = new Point3d((i + 1) * layerDistance, k * (2 * neuronRadius + 1) - neuronsPerLayer[i + 1], 0);
          Line connection = new Line(start, end);
          geometries.Add(connection.ToNurbsCurve());
        }
      }
    }

    // Output the geometry
    A = geometries;
  }

  // <Custom additional code> 

  // </Custom additional code> 
}
# ---------- end bernoulli_s_principle ----------
# PARAMETRIC
panel = Panel(bernoulli_s_principle.A)
panel_2 = Panel(bernoulli_s_principle.out)
