# Grasshopper definition 004_Sine_Function.gh (Grasshopper 1.0.7)
# plug-ins: RhinoCodePluginGH, Kangaroo2 Components

number_slider = Slider(2.85, range=0..10)  # disabled
number_slider_2 = Slider(5.95, range=0..10)  # disabled
# COMPLEX MODEL
# PARAMETRIC
sine_function = Script(multi=Slider(1.77, range=0..10), extDist=Slider(3.62, range=0..10))  # -> out, A; inputs multi: Double, extDist: Double
# ---------- sine_function: C# ----------
// Grasshopper Script Instance
using System;
using System.Collections;
using System.Collections.Generic;
using System.Drawing;

using Rhino;
using Rhino.Geometry;

using Grasshopper;
using Grasshopper.Kernel;
using Grasshopper.Kernel.Data;
using Grasshopper.Kernel.Types;

public class Script_Instance : GH_ScriptInstance
{
  private void RunScript(
    object x,
    object y,
    double multi,
    double extDist,
    out object A)
  {
    // Define the sinc function
    Func<double, double> sinc = t =>
    {
      return t == 0 ? 1 : Math.Sin(t) / t;
    };

    // Create a list to hold the points
    List<Point3d> points = new List<Point3d>();
    double tStep = Math.PI / 180; // Step size in radians for t
    double range = multi * Math.PI; // Define the range for t

    // Loop through a range of t values to create points
    for (double t = -range; t <= range; t += tStep)
    {
      // Evaluate the sinc function at t
      double z = sinc(t);
      // Create a point at (t, 0, sinc(t))
      points.Add(new Point3d(t, 0, z));
    }

    // Create a curve through the points
    Curve sincCurve = Curve.CreateInterpolatedCurve(points, 3);

    // Create a variable extrusion along the curve
    List<Brep> breps = new List<Brep>();
    for (int i = 0; i < points.Count - 1; i++)
    {
      Line line = new Line(points[i], points[i + 1]);
      double localExtrusion = extDist * sinc(line.Length);
      Extrusion extrusion = Extrusion.Create(line.ToNurbsCurve(), localExtrusion, true);
      breps.Add(extrusion.ToBrep());
    }

    // Rotate the curves to create a dynamic shape
    double rotationStep = Math.PI / 18; // Rotation step in radians
    for (int i = 0; i < breps.Count; i++)
    {
      double angle = i * rotationStep;
      breps[i].Transform(Transform.Rotation(angle, Vector3d.ZAxis, Point3d.Origin));
    }

    // Output the individual Breps
    A = breps;
  }

  // <Custom additional code> 

}
# ---------- end sine_function ----------
# Sine
# Function
# HARD CODED
sine_function_2 = Script()  # -> out, A; disabled
# ---------- sine_function_2: C# ----------
// Grasshopper Script Instance
using System;
using System.Collections;
using System.Collections.Generic;
using System.Drawing;

using Rhino;
using Rhino.Geometry;

using Grasshopper;
using Grasshopper.Kernel;
using Grasshopper.Kernel.Data;
using Grasshopper.Kernel.Types;

// Grasshopper Script Instance
//#! csharp
using System;
using System.Collections.Generic;
using Rhino.Geometry;
using Grasshopper.Kernel;

public class Script_Instance : GH_ScriptInstance
{
  private void RunScript(object x, object y, out object A)
  {
    // Define the sinc function
    Func<double, double> sinc = t =>
    {
      return t == 0 ? 1 : Math.Sin(t) / t;
    };

    // Create a list to hold the points
    List<Point3d> points = new List<Point3d>();
    double tStep = Math.PI / 180; // Step size in radians for t
    double range = 10 * Math.PI; // Define the range for t

    // Loop through a range of t values to create points
    for (double t = -range; t <= range; t += tStep)
    {
      // Evaluate the sinc function at t
      double z = sinc(t);
      // Create a point at (t, 0, sinc(t))
      points.Add(new Point3d(t, 0, z));
    }

    // Create a curve through the points
    Curve sincCurve = Curve.CreateInterpolatedCurve(points, 3);

    // Set the extrusion distance
    double extrusionDistance = 1; // Change this to your desired extrusion distance

    // Extrude the curve to create a surface
    Vector3d extrusionVec = new Vector3d(0, extrusionDistance, 0); // Extrude in the y-direction
    Extrusion sincExtrusion = Extrusion.Create(sincCurve, extrusionDistance, true);
    
    // Convert extrusion to a Brep for output
    Brep sincBrep = sincExtrusion.ToBrep();

    // Output the Brep
    A = sincBrep;
  }

  // <Custom additional code> 

}
# ---------- end sine_function_2 ----------
# PARAMETRIC
sine_function_3 = Script(multi=number_slider, extDist=number_slider_2)  # -> out, A; inputs multi: Double, extDist: Double; disabled
# ---------- sine_function_3: C# ----------
// Grasshopper Script Instance
using System;
using System.Collections;
using System.Collections.Generic;
using System.Drawing;

using Rhino;
using Rhino.Geometry;

using Grasshopper;
using Grasshopper.Kernel;
using Grasshopper.Kernel.Data;
using Grasshopper.Kernel.Types;

public class Script_Instance : GH_ScriptInstance
{
  private void RunScript(
	object x,
	object y,
	double multi,
	double extDist,
	out object A)
  {
    // Define the sinc function
    Func<double, double> sinc = t =>
    {
      return t == 0 ? 1 : Math.Sin(t) / t;
    };

    // Create a list to hold the points
    List<Point3d> points = new List<Point3d>();
    double tStep = Math.PI / 180; // Step size in radians for t
    double range = multi * Math.PI; // Define the range for t

    // Loop through a range of t values to create points
    for (double t = -range; t <= range; t += tStep)
    {
      // Evaluate the sinc function at t
      double z = sinc(t);
      // Create a point at (t, 0, sinc(t))
      points.Add(new Point3d(t, 0, z));
    }

    // Create a curve through the points
    Curve sincCurve = Curve.CreateInterpolatedCurve(points, 3);

    // Set the extrusion distance
    double extrusionDistance = extDist; // Change this to your desired extrusion distance

    // Extrude the curve to create a surface
    Vector3d extrusionVec = new Vector3d(0, extrusionDistance, 0); // Extrude in the y-direction
    Extrusion sincExtrusion = Extrusion.Create(sincCurve, extrusionDistance, true);
    
    // Convert extrusion to a Brep for output
    Brep sincBrep = sincExtrusion.ToBrep();

    // Output the Brep
    A = sincBrep;
  }

  // <Custom additional code> 

}
# ---------- end sine_function_3 ----------
number_slider_3 = Slider(0.1, range=0..1)  # disabled
panel = Panel(sine_function_2.A)  # disabled
panel_2 = Panel(sine_function_2.out)  # disabled
panel_3 = Panel(sine_function.A)
panel_4 = Panel(sine_function.out)
panel_5 = Panel(sine_function_3.A)  # disabled
panel_6 = Panel(sine_function_3.out)  # disabled
multipipe = MultiPipe(Curves=sine_function.A, NodeSize=number_slider_3, EndOffset=1, StrutSize=1, Segment=0, KinkAngle=0.6, CubeFit=0, Caps=0)  # disabled
