# Grasshopper definition 005_New_Experiment.gh (Grasshopper 1.0.7)
# plug-ins: RhinoCodePluginGH, Kangaroo2 Components

# ----
# Image Prompt from Grasshopper/Rhino Bake
number_slider = Slider(-1.939, range=-3..3)
construct_domain = ConstructDomain(DomainStart=number_slider, DomainEnd=Slider(0.302, range=-3..3))
range = Range(Domain=construct_domain, Steps=10)
construct_point = ConstructPoint(XCoordinate=range, YCoordinate=range, ZCoordinate=0)
construct_point_2 = ConstructPoint(XCoordinate=0, YCoordinate=0, ZCoordinate=0)
sphere = Sphere(Base=PlaneXY(0, 0, 0), Radius=1)
evaluate_surface = EvaluateSurface(Surface=reparameterize(sphere), Point=construct_point)  # -> Point, Normal, UDirection, VDirection, Frame
cylinder = Cylinder(Base=PlaneXY(0, 0, 0), Radius=0.5, Length=1)
plane_normal = PlaneNormal(Origin=construct_point_2, ZAxis=evaluate_surface.Normal)
vector_display = VectorDisplay(Anchor=construct_point_2, Vector=evaluate_surface.Normal)
brep_plane = BrepPlane(Brep=cylinder, Plane=plane_normal)  # -> Curves, Points
curve = Curve(brep_plane.Curves)
multipipe = MultiPipe(Curves=curve, NodeSize=Slider(0.03, range=0..1), EndOffset=1, StrutSize=1, Segment=0, KinkAngle=0.6, CubeFit=0, Caps=0)
# PARAMETRIC
# COMPLEX MODEL
# PARAMETRIC
geometry = Geometry(multipipe)

# ----
# New Experiment
# gpt-4 attempts to write a C# script
# that re-create a parametric model
# created in grasshopper in a
# single node editor
# (unsuccessful)
# HARD CODED
experiment_001 = Script()  # -> out, a
# ---------- experiment_001: C# ----------
// Grasshopper Script Instance
using System;
using System.Collections;
using System.Collections.Generic;
using System.Drawing;

using Rhino;
using Rhino.Geometry;

using Grasshopper;
using Grasshopper.Kernel;
using Grasshopper.Kernel.Data;
using Grasshopper.Kernel.Types;

//Grasshopper Script Instance
//#! csharp
using System;
using System.Collections.Generic;
using System.Drawing;
using Rhino;
using Rhino.Geometry;
using Grasshopper;
using Grasshopper.Kernel;
using Grasshopper.Kernel.Data;
using Grasshopper.Kernel.Types;

public class Script_Instance : GH_ScriptInstance
{
  private void RunScript(object x, object y, out object a)
  {
    // Initialize a list to store the generated geometry
    List<Brep> breps = new List<Brep>();

    // Define the number of cylinders and their dimensions
    int numberOfCylinders = 100; // For example
    double minLength = 1.0; // Minimum length of the cylinders
    double maxLength = 5.0; // Maximum length of the cylinders
    double radius = 0.1; // Radius of the cylinders

    // Use a random number generator
    Random rnd = new Random();

    for(int i = 0; i < numberOfCylinders; i++)
    {
      // Generate random start point
      Point3d start = new Point3d(
        rnd.NextDouble() * 10, // Random X within a range
        rnd.NextDouble() * 10, // Random Y within a range
        rnd.NextDouble() * 10  // Random Z within a range
      );

      // Generate a random end point based on the start point
      Point3d end = new Point3d(
        start.X + rnd.NextDouble() * (maxLength - minLength) + minLength,
        start.Y + rnd.NextDouble() * (maxLength - minLength) + minLength,
        start.Z + rnd.NextDouble() * (maxLength - minLength) + minLength
      );

      // Create the cylinder
      Cylinder cylinder = new Cylinder(new Circle(new Plane(start, end - start), radius), start.DistanceTo(end));
      Brep brep = cylinder.ToBrep(true, true);
      breps.Add(brep);
    }

    // Output the geometry
    a = breps;
  }

  // <Custom additional code> 
}
# ---------- end experiment_001 ----------
panel = Panel(experiment_001.a)
panel_2 = Panel(experiment_001.out)
