# Grasshopper definition 008_arch.gh (Grasshopper 1.0.7)
# plug-ins: RhinoCodePluginGH

# architecture
# HARD CODED
architecture = Script()  # -> out, A
# ---------- architecture: C# ----------
// Grasshopper Script Instance
using System;
using System.Collections;
using System.Collections.Generic;
using System.Drawing;

using Rhino;
using Rhino.Geometry;

using Grasshopper;
using Grasshopper.Kernel;
using Grasshopper.Kernel.Data;
using Grasshopper.Kernel.Types;
# ---------- end architecture ----------
# PARAMETRIC
# COMPLEX MODEL
# PARAMETRIC
panel = Panel(architecture.A)
panel_2 = Panel(architecture.out)
