# Grasshopper definition 009_GilbreathsConjecture.gh (Grasshopper 1.0.7)
# plug-ins: RhinoCodePluginGH

# Gilbreath's
# Conjecture
# HARD CODED
gilbreath_s_conjecture = Script()  # -> out, a; disabled
# ---------- gilbreath_s_conjecture: C# ----------
// Grasshopper Script Instance
using System;
using System.Collections;
using System.Collections.Generic;
using System.Drawing;

using Rhino;
using Rhino.Geometry;

using Grasshopper;
using Grasshopper.Kernel;
using Grasshopper.Kernel.Data;
using Grasshopper.Kernel.Types;

// Grasshopper Script Instance
//#! csharp
using System;
using System.Collections.Generic;
using Rhino.Geometry;

public class Script_Instance : GH_ScriptInstance
{
  private void RunScript(object x, object y, out object a)
  {
    // Initialize a list of primes - this would need to be replaced with an actual list of primes
    var primes = new List<int> { 2, 3, 5, 7, 11, 13, 17, 19, 23, 29, 31 };
    var points = new List<Point3d>();
    
    // Use the conjecture to calculate differences and position points in 3D space
    for (int n = 0; n < primes.Count - 1; n++)
    {
      // Calculate the first-order difference
      int diff = Math.Abs(primes[n + 1] - primes[n]);
      
      // For simplicity, we're just placing points in a straight line here
      // In a real model, you might want to use these differences to define shapes, distances, or other properties
      points.Add(new Point3d(n * 10, diff, 0)); // 10 is an arbitrary spacing value
    }
    
    // Here we would have to define the logic to use the differences to create geometry
    // For now, we're just outputting the points
    a = points;
  }
  
  // <Custom additional code> 
}
# ---------- end gilbreath_s_conjecture ----------
# PARAMETRIC
gilbreath_s_conjecture_2 = Script()  # -> out, a
# ---------- gilbreath_s_conjecture_2: C# ----------
// Grasshopper Script Instance
using System;
using System.Collections;
using System.Collections.Generic;
using System.Drawing;

using Rhino;
using Rhino.Geometry;

using Grasshopper;
using Grasshopper.Kernel;
using Grasshopper.Kernel.Data;
using Grasshopper.Kernel.Types;

// Grasshopper Script Instance
//#! csharp
using System;
using System.Collections.Generic;
using Rhino.Geometry;

public class Script_Instance : GH_ScriptInstance
{
  private void RunScript(object x, object y, out object a)
  {
    // List of primes for demonstration purposes.
    var primes = new List<int> { 2, 3, 5, 7, 11, 13, 17, 19, 23, 29, 31 };
    var columns = new List<Brep>();

    // Create a list to store the first-order differences
    var firstOrderDiffs = new List<int>();
    for (int i = 0; i < primes.Count - 1; i++)
    {
      firstOrderDiffs.Add(primes[i + 1] - primes[i]);
    }

    // Create a list to store the second-order differences
    var secondOrderDiffs = new List<int>();
    for (int i = 0; i < firstOrderDiffs.Count - 1; i++)
    {
      secondOrderDiffs.Add(Math.Abs(firstOrderDiffs[i + 1] - firstOrderDiffs[i]));
    }

    // Define a base plane to start the columns from
    Plane basePlane = Plane.WorldXY;

    // Loop over the first-order differences to create the columns
    for (int i = 0; i < firstOrderDiffs.Count; i++)
    {
      // Use the first-order difference for the height of the column
      double height = firstOrderDiffs[i];
      // Use the second-order difference for the radius, with some scaling factor
      double radius = i < secondOrderDiffs.Count ? secondOrderDiffs[i] * 0.5 : 1.0; // Apply a scaling factor for visualisation
      
      // Ensure radius is not zero to create a valid circle
      if (radius < 0.1) radius = 0.1;
      
      // Create a circle at the base plane
      Circle baseCircle = new Circle(basePlane, radius);
      
      // Extrude the circle to create the column
      Cylinder columnCylinder = new Cylinder(baseCircle, height);
      Brep column = columnCylinder.ToBrep(true, true);
      
      // Move the column to its position
      column.Translate(i * 10, 0, 0); // 10 is an arbitrary spacing value between columns
      
      columns.Add(column);
    }
    
    a = columns;
  }
  
  // <Custom additional code> 
}
# ---------- end gilbreath_s_conjecture_2 ----------
panel = Panel(gilbreath_s_conjecture.a)  # disabled
panel_2 = Panel(gilbreath_s_conjecture.out)  # disabled
# COMPLEX MODEL
# PARAMETRIC
panel_3 = Panel(gilbreath_s_conjecture_2.a)
panel_4 = Panel(gilbreath_s_conjecture_2.out)
interpolate = Interpolate(Vertices=gilbreath_s_conjecture.a, Degree=3, Periodic=False, KnotStyle=1)  # -> Curve, Length, Domain; disabled
