# Grasshopper definition 010_FaradaysLawInduction.gh (Grasshopper 1.0.7)
# plug-ins: RhinoCodePluginGH

number_slider = Slider(6.78, range=0..10)  # disabled
# COMPLEX MODEL
# PARAMETRIC
faraday_s_law_induction = Script(
    time=Slider(2.81, range=0..10),
    loopRadius=Slider(3.31, range=0..10),
    fieldStrength=Slider(1.91, range=0..3),
    fieldLineSpacing=Slider(1.48, range=0..3),
    fieldLineCount=Slider(8, range=0..20),
    fieldHeight=Slider(10, range=0..10),
    loopHeight=Slider(4.3, range=0..10))  # -> out, FieldLines, Loop, EMF_Indicator; inputs time: Double, loopRadius: Double, fieldStrength: Double, fieldLineSpacing: Double, fieldLineCount: Int32, fieldHeight: Double, loopHeight: Double
# ---------- faraday_s_law_induction: C# ----------
// Grasshopper Script Instance
using System;
using System.Collections;
using System.Collections.Generic;
using System.Drawing;

using Rhino;
using Rhino.Geometry;

using Grasshopper;
using Grasshopper.Kernel;
using Grasshopper.Kernel.Data;
using Grasshopper.Kernel.Types;

// Grasshopper Script Instance
//#! csharp
using System;
using System.Collections.Generic;
using Rhino.Geometry;

public class Script_Instance : GH_ScriptInstance
{
  private void RunScript(
	double time,
	double loopRadius,
	double fieldStrength,
	double fieldLineSpacing,
	int fieldLineCount,
	double fieldHeight,
	double loopHeight,
	out object FieldLines,
	out object Loop,
	out object EMF_Indicator)
  {
    // Parameters for the model
    //double loopRadius = 5.0; // Radius of the loop
    //double fieldStrength = 1.0; // Strength of the magnetic field
    //double fieldLineSpacing = 1.0; // Spacing between field lines
    //int fieldLineCount = 10; // Number of field lines
    //double fieldHeight = 10.0; // Height of the field lines
    //double loopHeight = Math.Sin(time) * 5.0; // Height of the loop changes over time, simulating motion through the field

    // Create the magnetic field lines
    List<LineCurve> fieldLines = new List<LineCurve>();
    for (int i = -fieldLineCount / 2; i <= fieldLineCount / 2; i++)
    {
      for (int j = -fieldLineCount / 2; j <= fieldLineCount / 2; j++)
      {
        Point3d start = new Point3d(i * fieldLineSpacing, j * fieldLineSpacing, -fieldHeight / 2);
        Point3d end = new Point3d(i * fieldLineSpacing, j * fieldLineSpacing, fieldHeight / 2);
        fieldLines.Add(new LineCurve(start, end));
      }
    }
    FieldLines = fieldLines;

    // Create the wire loop
    Plane loopPlane = new Plane(new Point3d(0, 0, loopHeight), Vector3d.ZAxis);
    Loop = new Circle(loopPlane, loopRadius).ToNurbsCurve();

    // Calculate the rate of change of the magnetic flux
    // Represent the EMF as a circle whose radius changes with the rate of change of loopHeight
    double emfStrength = Math.Cos(time) * fieldStrength; // Arbitrary representation of changing EMF
    Plane emfPlane = new Plane(new Point3d(0, 0, loopHeight), Vector3d.ZAxis);
    EMF_Indicator = new Circle(emfPlane, loopRadius * Math.Abs(emfStrength)).ToNurbsCurve();
  }

  // <Custom additional code> 
}
# ---------- end faraday_s_law_induction ----------
faraday_s_law_induction_2 = Script(time=number_slider)  # -> out, FieldLines, Loop, EMF_Indicator; inputs time: Double; disabled
# ---------- faraday_s_law_induction_2: C# ----------
// Grasshopper Script Instance
using System;
using System.Collections;
using System.Collections.Generic;
using System.Drawing;

using Rhino;
using Rhino.Geometry;

using Grasshopper;
using Grasshopper.Kernel;
using Grasshopper.Kernel.Data;
using Grasshopper.Kernel.Types;

// Grasshopper Script Instance
//#! csharp
using System;
using System.Collections.Generic;
using Rhino.Geometry;

public class Script_Instance : GH_ScriptInstance
{
  private void RunScript(
	double time,
	out object FieldLines,
	out object Loop,
	out object EMF_Indicator)
  {
    // Parameters for the model
    double loopRadius = 5.0; // Radius of the loop
    double fieldStrength = 1.0; // Strength of the magnetic field
    double fieldLineSpacing = 1.0; // Spacing between field lines
    int fieldLineCount = 10; // Number of field lines
    double fieldHeight = 10.0; // Height of the field lines
    double loopHeight = Math.Sin(time) * 5.0; // Height of the loop changes over time, simulating motion through the field

    // Create the magnetic field lines
    List<LineCurve> fieldLines = new List<LineCurve>();
    for (int i = -fieldLineCount / 2; i <= fieldLineCount / 2; i++)
    {
      for (int j = -fieldLineCount / 2; j <= fieldLineCount / 2; j++)
      {
        Point3d start = new Point3d(i * fieldLineSpacing, j * fieldLineSpacing, -fieldHeight / 2);
        Point3d end = new Point3d(i * fieldLineSpacing, j * fieldLineSpacing, fieldHeight / 2);
        fieldLines.Add(new LineCurve(start, end));
      }
    }
    FieldLines = fieldLines;

    // Create the wire loop
    Plane loopPlane = new Plane(new Point3d(0, 0, loopHeight), Vector3d.ZAxis);
    Loop = new Circle(loopPlane, loopRadius).ToNurbsCurve();

    // Calculate the rate of change of the magnetic flux
    // Represent the EMF as a circle whose radius changes with the rate of change of loopHeight
    double emfStrength = Math.Cos(time) * fieldStrength; // Arbitrary representation of changing EMF
    Plane emfPlane = new Plane(new Point3d(0, 0, loopHeight), Vector3d.ZAxis);
    EMF_Indicator = new Circle(emfPlane, loopRadius * Math.Abs(emfStrength)).ToNurbsCurve();
  }

  // <Custom additional code> 
}
# ---------- end faraday_s_law_induction_2 ----------
geometry = Geometry(faraday_s_law_induction.FieldLines)
geometry_2 = Geometry(faraday_s_law_induction.Loop)
geometry_3 = Geometry(faraday_s_law_induction.EMF_Indicator)
# Faraday's
# Law Induction
# HARD CODED
faraday_s_law_induction_3 = Script()  # -> out, a; disabled
# ---------- faraday_s_law_induction_3: C# ----------
// Grasshopper Script Instance
using System;
using System.Collections;
using System.Collections.Generic;
using System.Drawing;

using Rhino;
using Rhino.Geometry;

using Grasshopper;
using Grasshopper.Kernel;
using Grasshopper.Kernel.Data;
using Grasshopper.Kernel.Types;

// Grasshopper Script Instance
//#! csharp
using System;
using System.Collections;
using System.Collections.Generic;
using System.Drawing;

using Rhino;
using Rhino.Geometry;

using Grasshopper;
using Grasshopper.Kernel;
using Grasshopper.Kernel.Data;
using Grasshopper.Kernel.Types;

public class Script_Instance : GH_ScriptInstance
{
  private void RunScript(object x, object y, out object a)
  {
    // Initialize the list to hold the geometry
    List<GeometryBase> geometries = new List<GeometryBase>();

    // Define the magnetic field vector and the loop geometry
    Vector3d magneticField = new Vector3d(0, 0, 1); // Example magnetic field direction
    Circle loop = new Circle(Plane.WorldXY, 10); // Example loop with a radius of 10 units

    // Add the loop to the geometries
    geometries.Add(loop.ToNurbsCurve());

    // Visualize the magnetic field lines (for simplicity, using lines in the Z direction)
    for (int i = -5; i <= 5; i++)
    {
      for (int j = -5; j <= 5; j++)
      {
        Point3d start = new Point3d(i, j, -10);
        Point3d end = new Point3d(i, j, 10);
        LineCurve fieldLine = new LineCurve(start, end);
        geometries.Add(fieldLine);
      }
    }

    // TODO: Add logic to deform the loop or move it through the field to visualize induction

    // Set the output
    a = geometries;
  }

  // <Custom additional code> 
  // You can add any other functions or classes you need here
}
# ---------- end faraday_s_law_induction_3 ----------
geometry_4 = Geometry(faraday_s_law_induction_2.Loop)  # disabled
geometry_5 = Geometry(faraday_s_law_induction_2.FieldLines)  # disabled
geometry_6 = Geometry(faraday_s_law_induction_2.EMF_Indicator)  # disabled
panel = Panel(faraday_s_law_induction.out)
panel_2 = Panel(faraday_s_law_induction_3.a)  # disabled
entwine = Entwine(Branch00=geometry, Branch01=geometry_2, Branch02=geometry_3, FlattenInputs=True)
# PARAMETRIC
panel_3 = Panel(faraday_s_law_induction_2.out)  # disabled
panel_4 = Panel(faraday_s_law_induction_3.out)  # disabled
entwine_2 = Entwine(Branch00=geometry_5, Branch01=geometry_4, Branch02=geometry_6, FlattenInputs=True)  # disabled
panel_5 = Panel(entwine)
panel_6 = Panel(entwine_2)  # disabled
