# Grasshopper definition 011_Japanese_Wood_Joints.gh (Grasshopper 1.0.7)
# plug-ins: RhinoCodePluginGH

# Japanese
# Wood Joints
number_slider = Slider(100, range=0..100)
# COMPLEX MODEL
# PARAMETRIC
japanese_wood_joints = Script(
    length=number_slider,
    width=Slider(24.9, range=0..100),
    height=Slider(16.2, range=0..100),
    tailWidth=Slider(10.3, range=0..100),
    tailDepth=Slider(11.1, range=0..100),
    numberOfTails=Slider(5, range=0..10))  # -> out, Piece1, Piece2; inputs length: Double, width: Double, height: Double, tailWidth: Double, tailDepth: Double, numberOfTails: Int32
# ---------- japanese_wood_joints: C# ----------
// Grasshopper Script Instance
using System;
using System.Collections;
using System.Collections.Generic;
using System.Drawing;

using Rhino;
using Rhino.Geometry;

using Grasshopper;
using Grasshopper.Kernel;
using Grasshopper.Kernel.Data;
using Grasshopper.Kernel.Types;

public class Script_Instance : GH_ScriptInstance
{
    private void RunScript(
	double length,
	double width,
	double height,
	double tailWidth,
	double tailDepth,
	int numberOfTails,
	out object Piece1,
	out object Piece2)
    {
        // Initialize outputs
        Piece1 = null;
        Piece2 = null;

        // Define dimensions for the joint
        //double length = 100.0;
        //double width = 20.0;
       // double height = 20.0;
        //double tailWidth = 10.0; // Width of each dovetail tail
        //double tailDepth = width / 2; // Depth of each dovetail tail, half the width of the piece
        //int numberOfTails = 4; // Number of dovetail tails

        // Specify a tolerance for geometric operations
        double tolerance = 0.01;

        // Create the basic shape for the wood pieces
        Box basePiece = new Box(Plane.WorldXY, new Interval(0, length), new Interval(0, width), new Interval(0, height));
        Brep piece1Brep = basePiece.ToBrep();
        Brep piece2Brep = basePiece.ToBrep();

        // Create dovetail tails
        double tailSpacing = length / (numberOfTails + 1);
        for (int i = 0; i < numberOfTails; i++)
        {
            double tailCenter = tailSpacing * (i + 1);
            Box tailBox = new Box(Plane.WorldXY, new Interval(tailCenter - tailWidth / 2, tailCenter + tailWidth / 2), new Interval(0, tailDepth), new Interval(0, height));
            Brep tailBrep = tailBox.ToBrep();

            // Subtract tail from piece2 to create socket
            Brep[] result = Brep.CreateBooleanDifference(piece2Brep, tailBrep, tolerance);
            if (result == null || result.Length == 0)
            {
                Print("Boolean difference operation for tail failed.");
                return;
            }
            piece2Brep = result[0];
        }

        // Assign the geometries to the outputs
        Piece1 = piece1Brep;
        Piece2 = piece2Brep;
    }
}
# ---------- end japanese_wood_joints ----------
# HARD CODED
japanese_wood_joints_2 = Script()  # -> out, a; disabled
# ---------- japanese_wood_joints_2: C# ----------
// Grasshopper Script Instance
using System;
using System.Collections;
using System.Collections.Generic;
using System.Drawing;

using Rhino;
using Rhino.Geometry;

using Grasshopper;
using Grasshopper.Kernel;
using Grasshopper.Kernel.Data;
using Grasshopper.Kernel.Types;

// Grasshopper Script for a Complex Dovetail Joint in Rhino 8
// #! csharp
using System;
using System.Collections.Generic;
using Rhino;
using Rhino.Geometry;
using Grasshopper;
using Grasshopper.Kernel;

public class Script_Instance : GH_ScriptInstance
{
    private void RunScript(object x, object y, out object a)
    {
        // Initialize output
        a = null;

        // Define dimensions for the joint
        double length = 100.0;
        double width = 20.0;
        double height = 20.0;
        double tailWidth = 10.0; // Width of the dovetail
        double tailDepth = 5.0; // Depth of the dovetail

        // Specify a tolerance for geometric operations
        double tolerance = 0.01;

        // Create the basic shape for the wood pieces
        Box piece1 = new Box(Plane.WorldXY, new Interval(0, length), new Interval(0, width), new Interval(0, height));
        Box piece2 = new Box(Plane.WorldXY, new Interval(0, length), new Interval(0, width), new Interval(-height, 0));

        // Adjust points to ensure they are planar
        // Points are defined at the end of the wood piece
        Point3d[] dovetailPoints = {
            new Point3d(length, width / 2 - tailWidth / 2, 0),
            new Point3d(length, width / 2 + tailWidth / 2, 0),
            new Point3d(length, width / 2 + tailWidth / 2, tailDepth),
            new Point3d(length, width / 2, tailDepth + height / 2), // Peak of the dovetail
            new Point3d(length, width / 2 - tailWidth / 2, tailDepth),
            new Point3d(length, width / 2 - tailWidth / 2, 0) // Close the loop
        };
        PolylineCurve dovetailCurve = new PolylineCurve(dovetailPoints);

        if (dovetailCurve == null || !dovetailCurve.IsValid || !dovetailCurve.IsClosed)
        {
            Print("Dovetail curve creation failed or curve is not closed.");
            a = null;
            return;
        }

        // Check if the curve is planar
        if (!dovetailCurve.IsPlanar(tolerance))
        {
            Print("Dovetail curve is not planar.");
            a = null;
            return;
        }

        // Create the extrusion
        Extrusion dovetail = Extrusion.Create(dovetailCurve.ToNurbsCurve(), -width, true);
        if (dovetail == null || !dovetail.IsValid)
        {
            Print("Dovetail extrusion creation failed.");
            a = null;
            return;
        }

        // Subtract dovetail from piece2 to create the joint
        Brep piece1Brep = piece1.ToBrep();
        Brep dovetailBrep = dovetail.ToBrep();
        Brep[] piece2WithHole = Brep.CreateBooleanDifference(piece2.ToBrep(), dovetailBrep, tolerance);

        // Check for successful boolean operation
        if (piece2WithHole == null || piece2WithHole.Length == 0)
        {
            Print("Boolean difference operation failed.");
            a = null;
            return;
        }

        // Combine the two pieces to form the joint
        var joint = new List<GeometryBase> { piece1Brep, piece2WithHole[0] };

        // Assign the joint to the output
        a = joint;
    }
}
# ---------- end japanese_wood_joints_2 ----------
# Japanese
# Wood Joints
# HARD CODED
japanese_wood_joints_3 = Script()  # -> out, a; disabled
# ---------- japanese_wood_joints_3: C# ----------
// Grasshopper Script Instance
using System;
using System.Collections;
using System.Collections.Generic;
using System.Drawing;

using Rhino;
using Rhino.Geometry;

using Grasshopper;
using Grasshopper.Kernel;
using Grasshopper.Kernel.Data;
using Grasshopper.Kernel.Types;

// Grasshopper Script Template for Japanese Wood Joints in Rhino 8
// #! csharp
using System;
using System.Collections.Generic;
using System.Drawing;
using Rhino;
using Rhino.Geometry;
using Grasshopper;
using Grasshopper.Kernel;
using Grasshopper.Kernel.Data;
using Grasshopper.Kernel.Types;

public class Script_Instance : GH_ScriptInstance
{
    private void RunScript(object x, object y, out object a)
    {
        // Initialize output
        a = null;

        // Example: Modeling a basic Japanese wood joint
        // Note: This is a simplified example. Real-world joints are more complex.
        // 1. Define the dimensions and positions of the wood pieces.
        // 2. Create the interlocking shapes.
        // 3. Use boolean operations to create the joint.

        // Define dimensions (modify these values as needed)
        double length = 100.0;
        double width = 20.0;
        double height = 20.0;

        // Create basic box shapes for the wood pieces
        Box piece1 = new Box(Plane.WorldXY, new Interval(0, length), new Interval(0, width), new Interval(0, height));
        Box piece2 = new Box(Plane.WorldXY, new Interval(0, length), new Interval(0, width), new Interval(-height, 0));

        // Example transformation (rotation) to interlock the pieces
        piece2.Transform(Transform.Rotation(Math.PI / 2, new Point3d(length / 2, width / 2, 0)));

        // Creating the joint (modify this logic to fit the specific joint type)
        // This is a placeholder for the boolean operation or other geometric manipulations
        // required to create the actual joint.

        // For now, just group the two pieces together
        var joint = new List<GeometryBase> { piece1.ToBrep(), piece2.ToBrep() };

        // Assign the joint to the output
        a = joint;
    }

    // <Custom additional code> (if needed)
}
# ---------- end japanese_wood_joints_3 ----------
panel = Panel(japanese_wood_joints_2.a)  # disabled
panel_2 = Panel(japanese_wood_joints_3.a)  # disabled
# PARAMETRIC
panel_3 = Panel(japanese_wood_joints_2.out)  # disabled
# PARAMETRIC
panel_4 = Panel(japanese_wood_joints_3.out)  # disabled
geometry = Geometry(japanese_wood_joints.Piece1)
geometry_2 = Geometry(japanese_wood_joints.Piece2)
panel_5 = Panel(japanese_wood_joints.out)
panel_6 = Panel([geometry, geometry_2])
