# Grasshopper definition 013_Bridge_Building.gh (Grasshopper 1.0.7)
# plug-ins: RhinoCodePluginGH

lego_component = Script()  # -> out, A
# ---------- lego_component: C# ----------
// Grasshopper Script Instance
using System;
using System.Collections;
using System.Collections.Generic;
using System.Drawing;

using Rhino;
using Rhino.Geometry;

using Grasshopper;
using Grasshopper.Kernel;
using Grasshopper.Kernel.Data;
using Grasshopper.Kernel.Types;

//Grasshopper Script Instance
//#! csharp
using System;
using System.Collections;
using System.Collections.Generic;
using System.Drawing;

using Rhino;
using Rhino.Geometry;

using Grasshopper;
using Grasshopper.Kernel;
using Grasshopper.Kernel.Data;
using Grasshopper.Kernel.Types;

public class Script_Instance : GH_ScriptInstance
{
  private void RunScript(object x, object y, out object A)
  {
    // Parameters for brick dimensions
    double brickLength = 40.0; // Length of the brick
    double brickWidth = 20.0;  // Width of the brick
    double brickHeight = 24.0; // Height of the brick
    double studDiameter = 8.0; // Diameter of the cylindrical stud
    double studHeight = 4.0;   // Height of the cylindrical stud
    int studsX = 2;            // Number of studs in X direction
    int studsY = 4;            // Number of studs in Y direction
    int numberOfBricks = 12;   // Total number of bricks

    // Initialize a list to hold all the transformed brick geometries
    List<Brep> transformedBrickGeometries = new List<Brep>();

    // Define the trigonometric polynomial parameters
    double amplitude = 10.0; // Amplitude of the wave
    double frequency = 0.5;  // Frequency of the wave
    double phaseShift = 0.3; // Phase shift of the wave

    for (int n = 0; n < numberOfBricks; n++)
    {
      // Calculate the wave function value for this brick
      double waveValue = amplitude * Math.Sin(frequency * n + phaseShift);

      // Calculate rotation based on the derivative of the wave function (for a nice twist effect)
      double rotationAngle = Math.Cos(frequency * n + phaseShift);

      // Create the base box for the brick
      Box brickBox = new Box(Plane.WorldXY, new Interval(-brickLength / 2, brickLength / 2), new Interval(-brickWidth / 2, brickWidth / 2), new Interval(0, brickHeight));

      // Create the studs
      List<Cylinder> studs = new List<Cylinder>();
      for(int i = 0; i < studsX; i++)
      {
        for(int j = 0; j < studsY; j++)
        {
          Point3d basePoint = new Point3d(
            -brickLength / 2 + (brickLength / (studsX + 1)) * (i + 1),
            -brickWidth / 2 + (brickWidth / (studsY + 1)) * (j + 1),
            brickHeight);
          Circle studBase = new Circle(basePoint, studDiameter / 2);
          Cylinder stud = new Cylinder(studBase, studHeight);
          studs.Add(stud);
        }
      }

      // Combine the brick box with the stud cylinders
      List<Brep> breps = new List<Brep>();
      breps.Add(brickBox.ToBrep());
      foreach(Cylinder stud in studs)
      {
        breps.Add(stud.ToBrep(true, true));
      }

      // Join all breps into a single geometry for the current brick
      Brep[] joinedBreps = Brep.JoinBreps(breps, 0.01);
      Brep singleBrickGeometry = joinedBreps[0];

      // Apply the wave function to the brick position
      Transform translation = Transform.Translation(0, waveValue, n * brickHeight);

      // Apply rotation to the brick for a twist effect
      Transform rotation = Transform.Rotation(rotationAngle, new Vector3d(0, 0, 1), Point3d.Origin);

      // Combine translation and rotation
      singleBrickGeometry.Transform(rotation);
      singleBrickGeometry.Transform(translation);

      // Add the transformed brick geometry to the list
      transformedBrickGeometries.Add(singleBrickGeometry);
    }

    // Output the transformed geometries as the result
    A = transformedBrickGeometries;
  }
}
# ---------- end lego_component ----------
lego_component_2 = Script()  # -> out, A; disabled
# ---------- lego_component_2: C# ----------
// Grasshopper Script Instance
using System;
using System.Collections;
using System.Collections.Generic;
using System.Drawing;

using Rhino;
using Rhino.Geometry;

using Grasshopper;
using Grasshopper.Kernel;
using Grasshopper.Kernel.Data;
using Grasshopper.Kernel.Types;

//Grasshopper Script Instance
//#! csharp
using System;
using System.Collections;
using System.Collections.Generic;
using System.Drawing;

using Rhino;
using Rhino.Geometry;

using Grasshopper;
using Grasshopper.Kernel;
using Grasshopper.Kernel.Data;
using Grasshopper.Kernel.Types;

public class Script_Instance : GH_ScriptInstance
{
  private void RunScript(object x, object y, out object A)
  {
    // Parameters for brick dimensions
    double brickLength = 40.0; // Length of the brick
    double brickWidth = 20.0;  // Width of the brick
    double brickHeight = 24.0; // Height of the brick
    double studDiameter = 8.0; // Diameter of the cylindrical stud
    double studHeight = 4.0;   // Height of the cylindrical stud
    int studsX = 2;            // Number of studs in X direction
    int studsY = 4;            // Number of studs in Y direction
    int numberOfBricks = 12;   // Total number of bricks to create the helix
    double rotationDegrees = 30.0; // Angle to rotate each brick to form the helix
    double elevationIncrement = 5.0; // Elevation increment for each brick

    // Initialize a list to hold all the transformed brick geometries
    List<Brep> transformedBrickGeometries = new List<Brep>();

    for (int n = 0; n < numberOfBricks; n++)
    {
      // Create the base box for the brick
      Box brickBox = new Box(Plane.WorldXY, new Interval(-brickLength / 2, brickLength / 2), new Interval(-brickWidth / 2, brickWidth / 2), new Interval(0, brickHeight));

      // Create the studs for the current brick
      List<Cylinder> studs = new List<Cylinder>();
      for(int i = 0; i < studsX; i++)
      {
        for(int j = 0; j < studsY; j++)
        {
          Point3d basePoint = new Point3d(
            -brickLength / 2 + (brickLength / (studsX + 1)) * (i + 1),
            -brickWidth / 2 + (brickWidth / (studsY + 1)) * (j + 1),
            brickHeight);
          Circle studBase = new Circle(basePoint, studDiameter / 2);
          Cylinder stud = new Cylinder(studBase, studHeight);
          studs.Add(stud);
        }
      }

      // Combine the brick box with the stud cylinders
      List<Brep> breps = new List<Brep>();
      breps.Add(brickBox.ToBrep());
      foreach(Cylinder stud in studs)
      {
        breps.Add(stud.ToBrep(true, true));
      }

      // Join all breps into a single geometry for the current brick
      Brep[] joinedBreps = Brep.JoinBreps(breps, 0.01);
      Brep singleBrickGeometry = joinedBreps[0];

      // Calculate the transformation for the current brick
      // Rotate around Z axis and then translate up
      double rotationRadians = (rotationDegrees * n) * (Math.PI / 180.0);
      Transform rotation = Transform.Rotation(rotationRadians, Vector3d.ZAxis, Point3d.Origin);
      Transform translation = Transform.Translation(0, 0, n * (brickHeight + studHeight + elevationIncrement));

      // Combine the rotation and translation into a single transformation
      Transform combinedTransformation = Transform.Multiply(rotation, translation);

      // Apply the transformation to the current brick geometry
      singleBrickGeometry.Transform(combinedTransformation);

      // Add the transformed brick geometry to the list
      transformedBrickGeometries.Add(singleBrickGeometry);
    }

    // Output the transformed geometries as the result
    A = transformedBrickGeometries;
  }
}
# ---------- end lego_component_2 ----------
# Lego
# Component
# HARD CODED
lego_component_3 = Script()  # -> out, A; disabled
# ---------- lego_component_3: C# ----------
// Grasshopper Script Instance
using System;
using System.Collections;
using System.Collections.Generic;
using System.Drawing;

using Rhino;
using Rhino.Geometry;

using Grasshopper;
using Grasshopper.Kernel;
using Grasshopper.Kernel.Data;
using Grasshopper.Kernel.Types;

//Grasshopper Script Instance
//#! csharp
using System;
using System.Collections;
using System.Collections.Generic;
using System.Drawing;

using Rhino;
using Rhino.Geometry;

using Grasshopper;
using Grasshopper.Kernel;
using Grasshopper.Kernel.Data;
using Grasshopper.Kernel.Types;

public class Script_Instance : GH_ScriptInstance
{
  private void RunScript(object x, object y, out object A)
  {
    // Parameters for brick dimensions
    double brickLength = 40.0; // Length of the brick
    double brickWidth = 20.0;  // Width of the brick
    double brickHeight = 24.0; // Height of the brick
    double studDiameter = 8.0; // Diameter of the cylindrical stud
    double studHeight = 4.0;   // Height of the cylindrical stud
    int studsX = 2;            // Number of studs in X direction
    int studsY = 4;            // Number of studs in Y direction

    // Create the base box for the brick
    Box brickBox = new Box(Plane.WorldXY, new Interval(-brickLength / 2, brickLength / 2), new Interval(-brickWidth / 2, brickWidth / 2), new Interval(0, brickHeight));
    
    // Create the studs
    List<Cylinder> studs = new List<Cylinder>();
    for(int i = 0; i < studsX; i++)
    {
      for(int j = 0; j < studsY; j++)
      {
        Point3d basePoint = new Point3d(
          -brickLength / 2 + (brickLength / (studsX + 1)) * (i + 1),
          -brickWidth / 2 + (brickWidth / (studsY + 1)) * (j + 1),
          brickHeight);
        Circle studBase = new Circle(basePoint, studDiameter / 2);
        Cylinder stud = new Cylinder(studBase, studHeight);
        studs.Add(stud);
      }
    }

    // Combine the brick box with the stud cylinders
    List<Brep> breps = new List<Brep>();
    breps.Add(brickBox.ToBrep());
    foreach(Cylinder stud in studs)
    {
      breps.Add(stud.ToBrep(true, true));
    }

    // Join all breps into a single geometry
    Brep[] joinedBreps = Brep.JoinBreps(breps, 0.01);
    A = joinedBreps;
  }
}
# ---------- end lego_component_3 ----------
lego_component_4 = Script()  # -> out, A; disabled
# ---------- lego_component_4: C# ----------
// Grasshopper Script Instance
using System;
using System.Collections;
using System.Collections.Generic;
using System.Drawing;

using Rhino;
using Rhino.Geometry;

using Grasshopper;
using Grasshopper.Kernel;
using Grasshopper.Kernel.Data;
using Grasshopper.Kernel.Types;


//Grasshopper Script Instance
//#! csharp
using System;
using System.Collections;
using System.Collections.Generic;
using System.Drawing;

using Rhino;
using Rhino.Geometry;

using Grasshopper;
using Grasshopper.Kernel;
using Grasshopper.Kernel.Data;
using Grasshopper.Kernel.Types;

public class Script_Instance : GH_ScriptInstance
{
  private void RunScript(object x, object y, out object A)
  {
    // Parameters for brick dimensions
    double brickLength = 40.0; // Length of the brick
    double brickWidth = 20.0;  // Width of the brick
    double brickHeight = 24.0; // Height of the brick
    double studDiameter = 8.0; // Diameter of the cylindrical stud
    double studHeight = 4.0;   // Height of the cylindrical stud
    int studsX = 2;            // Number of studs in X direction
    int studsY = 4;            // Number of studs in Y direction
    int numberOfBricks = 12;   // Total number of bricks to stack

    // Create a list to hold all the brick geometries
    List<Brep> brickGeometries = new List<Brep>();

    for (int n = 0; n < numberOfBricks; n++)
    {
      // Create the base box for the brick
      Box brickBox = new Box(Plane.WorldXY, new Interval(-brickLength / 2, brickLength / 2), new Interval(-brickWidth / 2, brickWidth / 2), new Interval(0, brickHeight));

      // Create the studs for the current brick
      List<Cylinder> studs = new List<Cylinder>();
      for(int i = 0; i < studsX; i++)
      {
        for(int j = 0; j < studsY; j++)
        {
          Point3d basePoint = new Point3d(
            -brickLength / 2 + (brickLength / (studsX + 1)) * (i + 1),
            -brickWidth / 2 + (brickWidth / (studsY + 1)) * (j + 1),
            brickHeight);
          Circle studBase = new Circle(basePoint, studDiameter / 2);
          Cylinder stud = new Cylinder(studBase, studHeight);
          studs.Add(stud);
        }
      }

      // Combine the brick box with the stud cylinders
      List<Brep> breps = new List<Brep>();
      breps.Add(brickBox.ToBrep());
      foreach(Cylinder stud in studs)
      {
        breps.Add(stud.ToBrep(true, true));
      }

      // Join all breps into a single geometry for the current brick
      Brep[] joinedBreps = Brep.JoinBreps(breps, 0.01);
      Brep singleBrickGeometry = joinedBreps[0];

      // Transform the current brick geometry to its correct position in the stack
      Transform translation = Transform.Translation(0, 0, n * (brickHeight + studHeight));
      singleBrickGeometry.Transform(translation);

      // Add the transformed brick geometry to the list
      brickGeometries.Add(singleBrickGeometry);
    }

    // Combine all brick geometries into a single assembly
    Brep[] assembledBricks = Brep.JoinBreps(brickGeometries, 0.01);
    A = assembledBricks;
  }
}
# ---------- end lego_component_4 ----------
number_slider = Slider(13.4, range=0..100)  # disabled
number_slider_2 = Slider(4.5, range=0..10)  # disabled
# COMPLEX MODEL
# PARAMETRIC
number_slider_3 = Slider(2, range=0..10)  # disabled
# Lego Component
number_slider_4 = Slider(35.1, range=0..100)  # disabled
number_slider_5 = Slider(18.2, range=0..100)  # disabled
number_slider_6 = Slider(1.9, range=0..10)  # disabled
number_slider_7 = Slider(4, range=0..10)  # disabled
panel = Panel(lego_component_3.A)  # disabled
panel_2 = Panel(lego_component_2.A)  # disabled
panel_3 = Panel(lego_component_4.A)  # disabled
panel_4 = Panel(lego_component.out)
panel_5 = Panel(lego_component.A)
# PARAMETRIC
panel_6 = Panel(lego_component_3.out)  # disabled
panel_7 = Panel(lego_component_2.out)  # disabled
panel_8 = Panel(lego_component_4.out)  # disabled
lego_component_5 = Script(
    brickLength=number_slider_4,
    brickWidth=number_slider_5,
    brickHeight=number_slider,
    studDiameter=number_slider_2,
    studHeight=number_slider_6,
    studsX=number_slider_7,
    studsY=number_slider_3)  # -> out, A; inputs brickLength: Double, brickWidth: Double, brickHeight: Double, studDiameter: Double, studHeight: Double, studsX: Int32, studsY: Int32; disabled
# ---------- lego_component_5: C# ----------
// Grasshopper Script Instance
using System;
using System.Collections;
using System.Collections.Generic;
using System.Drawing;

using Rhino;
using Rhino.Geometry;

using Grasshopper;
using Grasshopper.Kernel;
using Grasshopper.Kernel.Data;
using Grasshopper.Kernel.Types;

public class Script_Instance : GH_ScriptInstance
{
  private void RunScript(
	double brickLength,
	double brickWidth,
	double brickHeight,
	double studDiameter,
	double studHeight,
	int studsX,
	int studsY,
	out object A)
  {
    // Create the base box for the brick
    Box brickBox = new Box(Plane.WorldXY, new Interval(-brickLength / 2, brickLength / 2), new Interval(-brickWidth / 2, brickWidth / 2), new Interval(0, brickHeight));
    
    // Create the studs
    List<Cylinder> studs = new List<Cylinder>();
    for(int i = 0; i < studsX; i++)
    {
      for(int j = 0; j < studsY; j++)
      {
        Point3d basePoint = new Point3d(
          -brickLength / 2 + (brickLength / (studsX + 1)) * (i + 1),
          -brickWidth / 2 + (brickWidth / (studsY + 1)) * (j + 1),
          brickHeight);
        Circle studBase = new Circle(basePoint, studDiameter / 2);
        Cylinder stud = new Cylinder(studBase, studHeight);
        studs.Add(stud);
      }
    }

    // Combine the brick box with the stud cylinders
    List<Brep> breps = new List<Brep>();
    breps.Add(brickBox.ToBrep());
    foreach(Cylinder stud in studs)
    {
      breps.Add(stud.ToBrep(true, true));
    }

    // Join all breps into a single geometry
    Brep[] joinedBreps = Brep.JoinBreps(breps, 0.01);
    A = joinedBreps;
  }
}
# ---------- end lego_component_5 ----------
# PARAMETRIC
panel_9 = Panel(lego_component_5.out)  # disabled
panel_10 = Panel(lego_component_5.A)  # disabled
