# Grasshopper definition 014_A;lgorithmicModel_001.gh (Grasshopper 1.0.7)
# plug-ins: RhinoCodePluginGH

# Algorithmic Model
# Algorithmic Model
number_slider = Slider(2, range=0..2)

# ----
# Oscillation Algorithm
# The oscillation algorithm can be use to animate
# any geometry that is driven by a number sliders.
# Simply swap out the number sliders at the
# multiplication node in the oscillation script.
trigger = Trigger(Interval=10, TimerInterval=10, Target=data_recorder)
data_recorder = DataRecorder("1", DataLimit=-10, RecordData=False)
list_length = ListLength(List=data_recorder)
division = Division(A=list_length, B=Slider(81, range=0..1000))
cosine = Cosine(Value=division)
sine = Sine(Value=division)
panel = Panel([sine, cosine])
multiplication = Multiplication(A=cosine, B=Slider(2, range=0..2))
multiplication_2 = Multiplication(A=sine, B=number_slider)

number_slider_2 = Slider(10, range=0..10)
number_slider_3 = Slider(10, range=0..10)
pi = Pi(Factor=multiplication_2)
pi_2 = Pi(Factor=multiplication)
# PARAMETRIC
algoirithmic_model_001 = Script(uDomain=pi, vDomain=pi_2, uCount=number_slider_2, vCount=number_slider_2)  # -> out, A; inputs uDomain: Double, vDomain: Double, uCount: Int32, vCount: Int32
# ---------- algoirithmic_model_001: C# ----------
// Grasshopper Script Instance
using System;
using System.Collections;
using System.Collections.Generic;
using System.Drawing;

using Rhino;
using Rhino.Geometry;

using Grasshopper;
using Grasshopper.Kernel;
using Grasshopper.Kernel.Data;
using Grasshopper.Kernel.Types;

//Grasshopper Script Instance
//#! csharp
using System;
using System.Collections.Generic;
using System.Drawing;

using Rhino;
using Rhino.Geometry;

using Grasshopper;
using Grasshopper.Kernel;
using Grasshopper.Kernel.Data;
using Grasshopper.Kernel.Types;

public class Script_Instance : GH_ScriptInstance
{
  private void RunScript(double uDomain, double vDomain, int uCount, int vCount, out object A)
  {
    // Initialize output
    A = null;

    // Validate input
    if (uCount <= 0 || vCount <= 0)
    {
      Print("Count parameters must be positive.");
      return;
    }

    // Create a list to hold the lattice lines
    var lines = new List<Line>();

    // Step through u and v domains to create points based on trigonometric polynomial
    for (int i = 0; i < uCount; i++)
    {
      for (int j = 0; j < vCount; j++)
      {
        double u = uDomain * i / uCount;
        double v = vDomain * j / vCount;

        // Trigonometric polynomial algorithm for point generation
        double x = Math.Sin(u) * Math.Cos(v);
        double y = Math.Sin(u) * Math.Sin(v);
        double z = Math.Cos(u) + Math.Cos(3 * v);

        Point3d point = new Point3d(x, y, z);

        // Create lattice structure around the point
        // Adjust the logic below to create your desired lattice pattern
        if (i < uCount - 1 && j < vCount - 1)
        {
          Point3d nextPointU = new Point3d(Math.Sin(u + uDomain / uCount) * Math.Cos(v), Math.Sin(u + uDomain / uCount) * Math.Sin(v), Math.Cos(u + uDomain / uCount) + Math.Cos(3 * v));
          Point3d nextPointV = new Point3d(Math.Sin(u) * Math.Cos(v + vDomain / vCount), Math.Sin(u) * Math.Sin(v + vDomain / vCount), Math.Cos(u) + Math.Cos(3 * (v + vDomain / vCount)));

          lines.Add(new Line(point, nextPointU));
          lines.Add(new Line(point, nextPointV));
        }
      }
    }

    // Set the lines as the output
    A = lines;
  }

  // Additional helper methods can be defined here
}
# ---------- end algoirithmic_model_001 ----------
# HARD CODED
algoirithmic_model_001_2 = Script()  # -> out, A; disabled
# ---------- algoirithmic_model_001_2: C# ----------
// Grasshopper Script Instance
using System;
using System.Collections;
using System.Collections.Generic;
using System.Drawing;

using Rhino;
using Rhino.Geometry;

using Grasshopper;
using Grasshopper.Kernel;
using Grasshopper.Kernel.Data;
using Grasshopper.Kernel.Types;

//Grasshopper Script Instance
//#! csharp
using System;
using System.Collections.Generic;
using System.Drawing;

using Rhino;
using Rhino.Geometry;

using Grasshopper;
using Grasshopper.Kernel;
using Grasshopper.Kernel.Data;
using Grasshopper.Kernel.Types;

public class Script_Instance : GH_ScriptInstance
{
  // Members: RhinoDoc RhinoDocument, GH_Document GrasshopperDocument, IGH_Component Component, int Iteration
  // Methods (Virtual & overridable): Print(string text), Print(string format, params object[] args), Reflect(object obj), Reflect(object obj, string method_name)

  private void RunScript(object x, object y, out object A)
  {
    // Initialize output
    A = null;

    // Check inputs
    if (x == null || y == null)
    {
      Print("Input parameters are null.");
      return;
    }

    // Example: Create a parametric geometry here based on inputs 'x' and 'y'
    // You can use RhinoCommon API methods to create and manipulate geometry

    // Example geometry creation
    var points = new List<Point3d>();
    // Algorithm to generate points based on inputs 'x' and 'y'
    // ...

    // Create a NURBS curve from points as an example of a geometric object
    if (points.Count > 1)
    {
      var curve = NurbsCurve.Create(false, 3, points);
      A = curve; // Set the curve as the output
    }
    else
    {
      Print("Insufficient points for curve creation.");
    }
  }

  // Additional helper methods can be defined here
}
# ---------- end algoirithmic_model_001_2 ----------
panel_2 = Panel(algoirithmic_model_001_2.out)  # disabled
panel_3 = Panel(algoirithmic_model_001_2.A)  # disabled
panel_4 = Panel(algoirithmic_model_001.out)
panel_5 = Panel(algoirithmic_model_001.A)
pipe = Pipe(Curve=algoirithmic_model_001.A, Radius=Slider(0.032, range=0..1), Caps=0)
