# Grasshopper definition 014_MeshMaking.gh (Grasshopper 1.0.7)
# plug-ins: RhinoCodePluginGH

number_slider = Slider(3, range=0..10)  # disabled
number_slider_2 = Slider(5.18, range=0..100)  # disabled
number_slider_3 = Slider(10.53, range=0..100)  # disabled
# Mesh Making
# HARD CODED
jmeshmaking_001 = Script(majorRadius=number_slider_3, minorRadius=number_slider_2, steps=number_slider)  # -> out, A; inputs majorRadius: Double, minorRadius: Double, steps: Int32; disabled
# ---------- jmeshmaking_001: C# ----------
// Grasshopper Script Instance
using System;
using System.Collections;
using System.Collections.Generic;
using System.Drawing;

using Rhino;
using Rhino.Geometry;

using Grasshopper;
using Grasshopper.Kernel;
using Grasshopper.Kernel.Data;
using Grasshopper.Kernel.Types;

using Rhino.Geometry;
using System.Collections.Generic;

// <Custom using directives>

public class Script_Instance : GH_ScriptInstance
{
  private void RunScript(
	double majorRadius,
	double minorRadius,
	int steps,
	out object A)
  {
    // Validate input
    if (steps <= 0)
    {
      A = null;
      return;
    }

    // Create the ellipse representing the orbit
    Ellipse ellipse = new Ellipse(Plane.WorldXY, majorRadius, minorRadius);
    Curve orbitCurve = ellipse.ToNurbsCurve();

    // Generate mesh
    Mesh mesh = new Mesh();
    Point3d sun = Plane.WorldXY.Origin;
    mesh.Vertices.Add(sun);

    // Divide the curve into equal segments and create triangular mesh faces
    for (int i = 1; i <= steps; ++i)
    {
      double t = orbitCurve.Domain.ParameterAt((double)i / steps);
      double tPrev = orbitCurve.Domain.ParameterAt((double)(i - 1) / steps);

      Point3d currentPoint = orbitCurve.PointAt(t);
      Point3d prevPoint = orbitCurve.PointAt(tPrev);

      mesh.Vertices.Add(prevPoint);
      mesh.Vertices.Add(currentPoint);

      int currentVertexIndex = mesh.Vertices.Count - 1;
      mesh.Faces.AddFace(0, currentVertexIndex - 1, currentVertexIndex);
    }

    mesh.Normals.ComputeNormals();
    mesh.Compact();

    A = mesh;
  }

  // <Custom additional code> 
}
# ---------- end jmeshmaking_001 ----------
# PARAMETRIC
jmeshmaking_001_2 = Script(
    majorRadius=Slider(100, range=0..100),
    minorRadius=Slider(31.93, range=0..100),
    steps=Slider(291, range=0..1000),
    height=Slider(32.1, range=0..100))  # -> out, MeshOut; inputs majorRadius: Double, minorRadius: Double, steps: Int32, height: Double
# ---------- jmeshmaking_001_2: C# ----------
// Grasshopper Script Instance
using System;
using System.Collections;
using System.Collections.Generic;
using System.Drawing;

using Rhino;
using Rhino.Geometry;

using Grasshopper;
using Grasshopper.Kernel;
using Grasshopper.Kernel.Data;
using Grasshopper.Kernel.Types;

public class Script_Instance : GH_ScriptInstance
{
  private void RunScript(
	double majorRadius,
	double minorRadius,
	int steps,
	double height,
	out object MeshOut)
  {
    // Initialize the MeshOut as null to handle early returns
    MeshOut = null;

    // Ensure the steps are valid
    if(steps <= 2)
    {
      Component.AddRuntimeMessage(GH_RuntimeMessageLevel.Error, "Steps must be greater than 2");
      return;
    }

    // Ensure the major and minor radii are valid
    if(majorRadius <= 0 || minorRadius <= 0)
    {
      Component.AddRuntimeMessage(GH_RuntimeMessageLevel.Error, "Radii must be greater than 0");
      return;
    }

    // Create an empty mesh
    Mesh mesh = new Mesh();

    // Define the central body (Sun)
    Point3d sun = new Point3d(0, 0, 0);
    
    // Add the Sun vertex to the mesh
    mesh.Vertices.Add(sun);

    // Create vertices for the ellipse and add the corresponding triangular faces
    for(int i = 0; i <= steps; i++)
    {
      // Calculate the angle for this step
      double angleRadians = 2 * Math.PI * i / steps;

      // Calculate the position of the point on the ellipse
      double x = majorRadius * Math.Cos(angleRadians);
      double y = minorRadius * Math.Sin(angleRadians);

      // Create a vertex for the current step
      Point3d currentVertex = new Point3d(x, y, height);
      mesh.Vertices.Add(currentVertex);

      // If this isn't the first step, add a face using the Sun, the previous vertex, and the current vertex
      if(i > 0)
      {
        mesh.Faces.AddFace(0, i, i + 1);
      }
    }

    // Add a face between the last and first vertices to close the mesh
    mesh.Faces.AddFace(0, steps, 1);

    // Optional: Compute the normals for the vertices
    mesh.Normals.ComputeNormals();
    
    // Optional: Compact the mesh to improve space efficiency
    mesh.Compact();

    // Set the output parameter to the created mesh
    MeshOut = mesh;
  }

  // <Custom additional code> (Leave blank if not needed)
}
# ---------- end jmeshmaking_001_2 ----------
panel = Panel(jmeshmaking_001_2.MeshOut)
panel_2 = Panel(jmeshmaking_001.out)  # disabled
panel_3 = Panel(jmeshmaking_001.A)  # disabled
panel_4 = Panel(jmeshmaking_001_2.out)
