# Grasshopper definition 015_role_playing_floorplan.gh (Grasshopper 1.0.7)
# plug-ins: RhinoCodePluginGH

# ----
# Oscillation Algorithm
# The oscillation algorithm can be use to animate
# any geometry that is driven by a number sliders.
# Simply swap out the number sliders at the
# multiplication node in the oscillation script.
trigger = Trigger(Interval=10, TimerInterval=10, Target=data_recorder)
data_recorder = DataRecorder("1", DataLimit=-10, RecordData=False)
list_length = ListLength(List=data_recorder)
division = Division(A=list_length, B=Slider(81, range=0..1000))
cosine = Cosine(Value=division)
sine = Sine(Value=division)
panel = Panel([sine, cosine])
multiplication = Multiplication(A=cosine)
multiplication_2 = Multiplication(A=sine)

number_slider = Slider(40, range=0..100)  # disabled
number_slider_2 = Slider(0.39, range=0..10)  # disabled
number_slider_3 = Slider(40, range=0..100)  # disabled
number_slider_4 = Slider(35.9, range=0..100)  # disabled
number_slider_5 = Slider(3.8, range=0..10)  # disabled
number_slider_6 = Slider(34.6, range=0..100)  # disabled
number_slider_7 = Slider(35.9, range=0..100)  # disabled
# Role Playing FloorPlan Model
# https://chat.openai.com/share/122388f8-0f5d-4621-baa0-2c85567e90af
number_slider_8 = Slider(3.8, range=0..10)  # disabled
number_slider_9 = Slider(34.6, range=0..100)  # disabled
role_playing_floorplan_model = Script(length=Slider(24.5, range=0..100), width=Slider(34.6, range=0..100), complexity=Slider(4.06, range=0..10))  # -> out, caveLayout; inputs length: Double, width: Double, complexity: Double
# ---------- role_playing_floorplan_model: C# ----------
// Grasshopper Script Instance
using System;
using System.Collections;
using System.Collections.Generic;
using System.Drawing;

using Rhino;
using Rhino.Geometry;

using Grasshopper;
using Grasshopper.Kernel;
using Grasshopper.Kernel.Data;
using Grasshopper.Kernel.Types;

//Grasshopper Script Instance
//#! csharp
using System;
using System.Collections.Generic;
using System.Drawing;
using System.Linq;

using Rhino;
using Rhino.Geometry;
using Rhino.Geometry.Intersect;

using Grasshopper;
using Grasshopper.Kernel;
using Grasshopper.Kernel.Data;
using Grasshopper.Kernel.Types;

public class Script_Instance : GH_ScriptInstance
{
  private void RunScript(double length, double width, double complexity, out List<GeometryBase> caveLayout)
  {
    caveLayout = new List<GeometryBase>();

    // Basic validation
    if (length <= 0 || width <= 0)
    {
      Print("Length and width must be greater than 0.");
      return;
    }

    // Create base rectangle for the cave floor
    Rectangle3d baseRect = new Rectangle3d(Plane.WorldXY, length, width);

    // Generate cave boundary
    var caveBoundary = GenerateCaveBoundary(baseRect, complexity);
    if (caveBoundary != null)
    {
        caveLayout.Add(caveBoundary);
    }

    // Generate internal features
    var internalFeatures = GenerateInternalFeatures(baseRect, complexity);
    caveLayout.AddRange(internalFeatures);

    // Generate wandering paths
    var paths = GenerateWanderingPaths(baseRect, complexity);
    caveLayout.AddRange(paths);
  }

  // Generate the cave boundary
  private Curve GenerateCaveBoundary(Rectangle3d baseRect, double complexity)
  {
    List<Point3d> caveBoundaryPoints = new List<Point3d>();
    int numPoints = 4;
    double noiseFactor = complexity * 0.05;

    for (int i = 0; i < numPoints; i++)
    {
      Point3d pt = baseRect.Corner(i);
      double noise = PerlinNoise(pt.X, pt.Y, noiseFactor);
      Point3d noisyPt = new Point3d(pt.X + noise, pt.Y + noise, pt.Z);
      caveBoundaryPoints.Add(noisyPt);
    }

    caveBoundaryPoints.Add(caveBoundaryPoints[0]);
    Polyline caveBoundary = new Polyline(caveBoundaryPoints);
    return caveBoundary.IsValid ? caveBoundary.ToNurbsCurve() : null;
  }

  // Generate internal features of the cave
  private List<GeometryBase> GenerateInternalFeatures(Rectangle3d baseRect, double complexity)
  {
    List<GeometryBase> features = new List<GeometryBase>();
    // Implementation of internal feature generation
    // This could include creating rooms, corridors, etc.
    return features;
  }

  // Generate wandering paths within the cave
  private List<Curve> GenerateWanderingPaths(Rectangle3d baseRect, double complexity)
  {
    int rows = (int)(complexity * 5);
    int cols = (int)(complexity * 5);
    double cellWidth = baseRect.Width / cols;
    double cellHeight = baseRect.Height / rows;
    bool[,] visited = new bool[rows, cols];

    int startRow = rows / 2;
    int startCol = cols / 2;
    visited[startRow, startCol] = true;

    List<Point3d> pathPoints = new List<Point3d>();
    GeneratePathDFS(startRow, startCol, visited, pathPoints, cellWidth, cellHeight, baseRect);

    List<Curve> paths = new List<Curve>();
    if (pathPoints.Count > 1)
    {
        Polyline pathPolyline = new Polyline(pathPoints);
        paths.Add(pathPolyline.ToNurbsCurve());
    }

    return paths;
  }

  private void GeneratePathDFS(int row, int col, bool[,] visited, List<Point3d> pathPoints, double cellWidth, double cellHeight, Rectangle3d baseRect)
  {
    int[,] dirs = new int[,] { { -1, 0 }, { 0, 1 }, { 1, 0 }, { 0, -1 } };
    var randomDirs = dirs.Cast<int>().OrderBy(x => Guid.NewGuid()).ToArray();

    for (int i = 0; i < randomDirs.Length; i += 2)
    {
      int newRow = row + randomDirs[i];
      int newCol = col + randomDirs[i + 1];

      if (newRow >= 0 && newRow < visited.GetLength(0) && newCol >= 0 && newCol < visited.GetLength(1) && !visited[newRow, newCol])
      {
        visited[newRow, newCol] = true;
        Point3d newPoint = new Point3d(baseRect.Corner(0).X + newCol * cellWidth, baseRect.Corner(0).Y + newRow * cellHeight, 0);
        pathPoints.Add(newPoint);
        GeneratePathDFS(newRow, newCol, visited, pathPoints, cellWidth, cellHeight, baseRect);
      }
    }
  }

  // Basic Perlin noise function
  private double PerlinNoise(double x, double y, double noiseFactor)
  {
    return (Math.Sin(x * noiseFactor) + Math.Cos(y * noiseFactor)) * noiseFactor;
  }
}
# ---------- end role_playing_floorplan_model ----------
# Role Playing FloorPlan Model
# HARD CODED
role_playing_floorplan_model_2 = Script(length=number_slider, width=number_slider_3, complexity=number_slider_2)  # -> out, caveFloorPlan; inputs length: Double, width: Double, complexity: Double; disabled
# ---------- role_playing_floorplan_model_2: C# ----------
// Grasshopper Script Instance
using System;
using System.Collections;
using System.Collections.Generic;
using System.Drawing;

using Rhino;
using Rhino.Geometry;

using Grasshopper;
using Grasshopper.Kernel;
using Grasshopper.Kernel.Data;
using Grasshopper.Kernel.Types;

public class Script_Instance : GH_ScriptInstance
{
  private void RunScript(
	double length,
	double width,
	double complexity,
	out object caveFloorPlan)
  {
    // Initialize the cave floor plan
    caveFloorPlan = null;

    // Basic validation
    if (length <= 0 || width <= 0)
    {
      Print("Length and width must be greater than 0.");
      return;
    }

    // Create base rectangle for the cave floor
    Rectangle3d baseRect = new Rectangle3d(Plane.WorldXY, length, width);

    // Generate cave geometry
    caveFloorPlan = GenerateCave(baseRect, complexity);
  }

  // <Custom additional code> 
  private object GenerateCave(Rectangle3d baseRect, double complexity)
  {
    // Here you would add your logic to modify the base rectangle
    // into a more complex cave shape based on the 'complexity' parameter.
    // This might involve adding or subtracting shapes, using noise functions, etc.

    // Placeholder for cave geometry
    var caveGeometry = new List<GeometryBase>();

    // Example: Modify the baseRect based on the complexity
    // ...

    // Return the final cave geometry
    return caveGeometry;
  }
}
# ---------- end role_playing_floorplan_model_2 ----------
# PARAMETRIC
role_playing_floorplan_model_3 = Script(length=number_slider_4, width=number_slider_6, complexity=number_slider_5)  # -> out, caveFloorPlan; inputs length: Double, width: Double, complexity: Double; disabled
# ---------- role_playing_floorplan_model_3: C# ----------
// Grasshopper Script Instance
using System;
using System.Collections;
using System.Collections.Generic;
using System.Drawing;

using Rhino;
using Rhino.Geometry;

using Grasshopper;
using Grasshopper.Kernel;
using Grasshopper.Kernel.Data;
using Grasshopper.Kernel.Types;

//Grasshopper Script Instance
//#! csharp
using System;
using System.Collections.Generic;
using System.Drawing;

using Rhino;
using Rhino.Geometry;
using Rhino.Geometry.Intersect;

using Grasshopper;
using Grasshopper.Kernel;
using Grasshopper.Kernel.Data;
using Grasshopper.Kernel.Types;

public class Script_Instance : GH_ScriptInstance
{
  private void RunScript(double length, double width, double complexity, out object caveFloorPlan)
  {
    caveFloorPlan = null;

    // Basic validation
    if (length <= 0 || width <= 0)
    {
      Print("Length and width must be greater than 0.");
      return;
    }

    // Create base rectangle for the cave floor
    Rectangle3d baseRect = new Rectangle3d(Plane.WorldXY, length, width);

    // Generate cave geometry
    caveFloorPlan = GenerateCave(baseRect, complexity);
  }

  // Generate the cave geometry
  private object GenerateCave(Rectangle3d baseRect, double complexity)
  {
    List<Point3d> caveBoundaryPoints = new List<Point3d>();

    // Simplify the geometry by reducing points
    int numPoints = 4; // Four corners of the rectangle
    double noiseFactor = complexity * 0.05; // Reduced noise factor

    // Apply noise to corner points
    for (int i = 0; i < numPoints; i++)
    {
      Point3d pt = baseRect.Corner(i);
      double noise = PerlinNoise(pt.X, pt.Y, noiseFactor); // Adjust noise function as needed
      Point3d noisyPt = new Point3d(pt.X + noise, pt.Y + noise, pt.Z);

      caveBoundaryPoints.Add(noisyPt);
    }

    // Close the polyline by adding the first point at the end
    caveBoundaryPoints.Add(caveBoundaryPoints[0]);

    // Create a polyline and convert it to a NURBS curve
    Polyline caveBoundary = new Polyline(caveBoundaryPoints);
    Curve caveBoundaryCurve = caveBoundary.ToNurbsCurve();

    // Check for self-intersection
    CurveIntersections intersections = Intersection.CurveSelf(caveBoundaryCurve, 0.01);
    if (!caveBoundary.IsValid || intersections.Count > 0)
    {
      Print("Invalid or self-intersecting polyline.");
      return null;
    }

    // Create a surface from the cave boundary
    var caveSurface = Brep.CreatePlanarBreps(caveBoundaryCurve);
    if (caveSurface == null || caveSurface.Length == 0)
    {
      Print("Failed to create a surface from the cave boundary.");
      return null;
    }

    return caveSurface[0];
  }

  // Basic Perlin noise function
  private double PerlinNoise(double x, double y, double noiseFactor)
  {
    // Implement a basic Perlin noise function
    return (Math.Sin(x * noiseFactor) + Math.Cos(y * noiseFactor)) * noiseFactor;
  }
}
# ---------- end role_playing_floorplan_model_3 ----------
# COMPLEX MODEL
role_playing_floorplan_model_4 = Script(length=number_slider_7, width=number_slider_9, complexity=number_slider_8)  # -> out, caveLayout; inputs length: Double, width: Double, complexity: Double; disabled
# ---------- role_playing_floorplan_model_4: C# ----------
// Grasshopper Script Instance
using System;
using System.Collections;
using System.Collections.Generic;
using System.Drawing;

using Rhino;
using Rhino.Geometry;

using Grasshopper;
using Grasshopper.Kernel;
using Grasshopper.Kernel.Data;
using Grasshopper.Kernel.Types;

//Grasshopper Script Instance
//#! csharp
using System;
using System.Collections.Generic;
using System.Drawing;

using Rhino;
using Rhino.Geometry;
using Rhino.Geometry.Intersect;

using Grasshopper;
using Grasshopper.Kernel;
using Grasshopper.Kernel.Data;
using Grasshopper.Kernel.Types;

public class Script_Instance : GH_ScriptInstance
{
  private void RunScript(double length, double width, double complexity, out List<GeometryBase> caveLayout)
  {
    caveLayout = new List<GeometryBase>();

    // Basic validation
    if (length <= 0 || width <= 0)
    {
      Print("Length and width must be greater than 0.");
      return;
    }

    // Create base rectangle for the cave floor
    Rectangle3d baseRect = new Rectangle3d(Plane.WorldXY, length, width);

    // Generate cave boundary
    var caveBoundary = GenerateCaveBoundary(baseRect, complexity);
    if (caveBoundary != null)
    {
        caveLayout.Add(caveBoundary);
    }

    // Generate internal features
    var internalFeatures = GenerateInternalFeatures(baseRect, complexity);
    caveLayout.AddRange(internalFeatures);
  }

  // Generate the cave boundary
  private Curve GenerateCaveBoundary(Rectangle3d baseRect, double complexity)
  {
    List<Point3d> caveBoundaryPoints = new List<Point3d>();
    int numPoints = 4;
    double noiseFactor = complexity * 0.05;

    for (int i = 0; i < numPoints; i++)
    {
      Point3d pt = baseRect.Corner(i);
      double noise = PerlinNoise(pt.X, pt.Y, noiseFactor);
      Point3d noisyPt = new Point3d(pt.X + noise, pt.Y + noise, pt.Z);
      caveBoundaryPoints.Add(noisyPt);
    }

    caveBoundaryPoints.Add(caveBoundaryPoints[0]);
    Polyline caveBoundary = new Polyline(caveBoundaryPoints);
    return caveBoundary.IsValid ? caveBoundary.ToNurbsCurve() : null;
  }

  // Generate internal features of the cave
  private List<GeometryBase> GenerateInternalFeatures(Rectangle3d baseRect, double complexity)
  {
    List<GeometryBase> features = new List<GeometryBase>();

    // Placeholder for internal feature generation logic
    // This could include creating rooms, corridors, etc., based on the complexity and size of the base rectangle

    return features;
  }

  // Basic Perlin noise function
  private double PerlinNoise(double x, double y, double noiseFactor)
  {
    return (Math.Sin(x * noiseFactor) + Math.Cos(y * noiseFactor)) * noiseFactor;
  }
}
# ---------- end role_playing_floorplan_model_4 ----------
panel_2 = Panel(role_playing_floorplan_model_2.caveFloorPlan)  # disabled
panel_3 = Panel(role_playing_floorplan_model_2.out)  # disabled
panel_4 = Panel(role_playing_floorplan_model_3.caveFloorPlan)  # disabled
panel_5 = Panel(role_playing_floorplan_model_3.out)  # disabled
panel_6 = Panel(role_playing_floorplan_model_4.out)  # disabled
panel_7 = Panel(role_playing_floorplan_model_4.caveLayout)  # disabled
panel_8 = Panel(role_playing_floorplan_model.out)
panel_9 = Panel(role_playing_floorplan_model.caveLayout)
