# Grasshopper definition 018_Digamma_Function.gh (Grasshopper 1.0.7)
# plug-ins: RhinoCodePluginGH

# Mesh Making
# HARD CODED
diagamma_function = Script()  # -> out, A; disabled
# ---------- diagamma_function: C# ----------
// Grasshopper Script Instance
using System;
using System.Collections;
using System.Collections.Generic;
using System.Drawing;

using Rhino;
using Rhino.Geometry;

using Grasshopper;
using Grasshopper.Kernel;
using Grasshopper.Kernel.Data;
using Grasshopper.Kernel.Types;

using System;
using System.Collections.Generic;
using Rhino.Geometry;

public class Script_Instance : GH_ScriptInstance
{
  private void RunScript(object x, object y, out object A)
  {
    // Interpret the mathematical function from the image
    Func<double, double> digammaFunction = z => Math.Log(z); // This is a placeholder, you'll need the actual function

    // Use the function to generate points in 3D space
    List<Point3d> points = new List<Point3d>();
    for(double i = 0.1; i < 10; i += 0.1) // Start at 0.1 to avoid singularity at 0
    {
      double functionValue = digammaFunction(i);
      points.Add(new Point3d(i, functionValue, 0)); // Points on the XY plane
    }

    // Create a curve through these points
    Curve curve = Curve.CreateInterpolatedCurve(points, 3);

    // Optionally, you can revolve the curve around an axis to create a surface or solid
    Vector3d axis = new Vector3d(0, 0, 1); // Z-axis
    Point3d axisBasePoint = new Point3d(0, 0, 0);
    Line axisLine = new Line(axisBasePoint, axisBasePoint + axis);
    RevSurface revSurface = RevSurface.Create(curve, axisLine);

    // Set output
    A = revSurface;
  }
}
# ---------- end diagamma_function ----------
# PARAMETRIC
construct_domain = ConstructDomain(DomainStart=Slider(9.54, range=0..100), DomainEnd=Slider(52.23, range=0..100))
panel = Panel(diagamma_function.out)  # disabled
panel_2 = Panel(diagamma_function.A)  # disabled
range = Range(Domain=construct_domain, Steps=10)
diagamma_function_2 = Script(x=range, y=Slider(4.09, range=1..10))  # -> out, A; inputs x: list of Double, y: Double
# ---------- diagamma_function_2: C# ----------
// Grasshopper Script Instance
using System;
using System.Collections;
using System.Collections.Generic;
using System.Drawing;

using Rhino;
using Rhino.Geometry;

using Grasshopper;
using Grasshopper.Kernel;
using Grasshopper.Kernel.Data;
using Grasshopper.Kernel.Types;

using System;
using System.Collections.Generic;
using Rhino.Geometry;

using System;
using System.Collections.Generic;
using Rhino.Geometry;

public class Script_Instance : GH_ScriptInstance
{
  /// <summary>Gets the current Rhino document.</summary>
  public Rhino.RhinoDoc RhinoDocument;

  /// <summary>Gets the Grasshopper script component which contains this script.</summary>
  public Grasshopper.Kernel.IGH_Component Component;

  private void RunScript(IEnumerable<double> x, double y, out object A)
  {
    // Initialize the output
    A = null;

    // Validate and cast the input 'x' to a List<double>
    if (!(x is List<double> xList) || xList.Count == 0)
    {
      this.AddRuntimeMessage(GH_RuntimeMessageLevel.Error, "Input 'x' must be a non-empty List<double>.");
      return;
    }

    // Validate and cast the input 'y' to double
    if (!(y is double yDouble))
    {
      this.AddRuntimeMessage(GH_RuntimeMessageLevel.Error, "Input 'y' must be a double.");
      return;
    }

    // Placeholder for the actual mathematical function to be modeled
    Func<double, double> modelFunction = input =>
    {
        // Example implementation; replace with actual function logic
        return Math.Log(input);
    };

    // Generate the points and curves based on the function
    List<Curve> functionCurves = new List<Curve>();
    for (double z = 0; z <= yDouble * 10; z += yDouble)
    {
      List<Point3d> points = new List<Point3d>();
      foreach (double xi in xList)
      {
        double functionValue = modelFunction(xi);
        points.Add(new Point3d(xi, functionValue, z));
      }
      Curve curve = Curve.CreateInterpolatedCurve(points, 3);
      functionCurves.Add(curve);
    }

    // Create a lofted surface from the generated curves
    if (functionCurves.Count > 1)
    {
      Brep[] loftedSurface = Brep.CreateFromLoft(functionCurves, Point3d.Unset, Point3d.Unset, LoftType.Normal, false);
      if (loftedSurface.Length > 0)
      {
        A = loftedSurface[0];
      }
    }
  }

  // <Custom additional code> 
  // </Custom additional code> 
}
# ---------- end diagamma_function_2 ----------
panel_3 = Panel(diagamma_function_2.out)
panel_4 = Panel(diagamma_function_2.A)
construct_domain_2 = ConstructDomain(DomainStart=Slider(1.5, range=0..10), DomainEnd=Slider(2.22, range=0..10))
range_2 = Range(Domain=construct_domain_2, Steps=10)
# Diagamma Function Chair
diagamma_function_3 = Script(x=range_2, y=Slider(3.26, range=1..10))  # -> out, A; inputs x: list of Double, y: Double
# ---------- diagamma_function_3: C# ----------
// Grasshopper Script Instance
using System;
using System.Collections;
using System.Collections.Generic;
using System.Drawing;

using Rhino;
using Rhino.Geometry;

using Grasshopper;
using Grasshopper.Kernel;
using Grasshopper.Kernel.Data;
using Grasshopper.Kernel.Types;

public class Script_Instance : GH_ScriptInstance
{
  private double Digamma(double x)
  {
    // Simple approximation for the Digamma function, for illustrative purposes
    return Math.Log(x) - 1 / (2 * x);
  }

  private void RunScript(IEnumerable<double> x, double y, out object A)
  {
    // Assume x is the range of values for which we want to apply the Digamma function
    // and y is the scaling factor for the function's amplitude.
    if (!(x is List<double> xList) || !(y is double yValue))
    {
      A = null;
      this.AddRuntimeMessage(GH_RuntimeMessageLevel.Error, "Invalid input types.");
      return;
    }

    // Parameters for the chair design
    double seatLength = 20.0; // Length of the seat
    double seatWidth = 10.0; // Width of the seat
    double backHeight = 20.0; // Height of the backrest
    double legHeight = 15.0; // Height of the legs

    // Create the seat
    Rectangle3d seatRect = new Rectangle3d(Plane.WorldXY, seatLength, seatWidth);
    Surface seatSurface = Surface.CreateExtrusion(seatRect.ToNurbsCurve(), new Vector3d(0, 0, 1)); // Flat surface for the seat

    // Use the Digamma function to define the curvature of the backrest
    List<Point3d> backPoints = new List<Point3d>();
    for (int i = 0; i < xList.Count; i++)
    {
      double xi = xList[i];
      double digammaValue = Digamma(xi) * yValue; // Scale the function value
      backPoints.Add(new Point3d(xi - seatLength / 2, seatWidth, digammaValue * backHeight));
    }
    Curve backCurve = Curve.CreateInterpolatedCurve(backPoints, 3);
    Surface backSurface = Surface.CreateExtrusion(backCurve, new Vector3d(0, -seatWidth, 0)); // Negative width for correct orientation

    // Create legs with an oscillating pattern using the Digamma function
    List<Brep> legs = new List<Brep>();
    for (int i = 0; i < 4; i++) // Four legs
    {
      Point3d basePt = new Point3d((i % 2) * seatLength, (i / 2) * seatWidth, 0); // Position the legs at the corners
      Point3d topPt = new Point3d(basePt.X, basePt.Y, -legHeight);
      double legCurveFactor = Digamma(i + 1) * yValue; // Apply the Digamma function for the leg curve

      // Calculate a control point for the arc which is halfway along the line between basePt and topPt,
      // and offset perpendicularly by legCurveFactor
      Point3d midPt = new Point3d((basePt.X + topPt.X) / 2, (basePt.Y + topPt.Y) / 2, (basePt.Z + topPt.Z) / 2);
      Vector3d perpDirection = new Vector3d(-seatWidth, 0, 0); // Perpendicular direction to the leg line
      perpDirection.Unitize();
      Point3d controlPt = midPt + perpDirection * legCurveFactor;

      // Define the arc by start, end, and a point on the arc
      Arc legArc = new Arc(basePt, controlPt, topPt);
      if (legArc.IsValid)
      {
        // Create an extrusion of the arc curve
        Curve legCurve = new ArcCurve(legArc);
        legs.Add(Brep.CreateFromSurface(Surface.CreateExtrusion(legCurve, new Vector3d(0, 0, 1))));
      }
    }

    // Combine all parts
    List<GeometryBase> chairParts = new List<GeometryBase>();
    chairParts.Add(seatSurface.ToBrep());
    chairParts.Add(backSurface.ToBrep());
    chairParts.AddRange(legs);

    // Output the combined chair parts
    A = chairParts;
  }

  // <Custom additional code> 
  // </Custom additional code> 
}
# ---------- end diagamma_function_3 ----------
panel_5 = Panel(diagamma_function_3.out)
panel_6 = Panel(diagamma_function_3.A)
