# Grasshopper definition 024_Uncertainty_Principle.gh (Grasshopper 1.0.7)
# plug-ins: RhinoCodePluginGH

number_slider = Slider(10.27, range=0..100)  # disabled
number_slider_2 = Slider(14.31, range=0..100)  # disabled
number_slider_3 = Slider(2.02, range=0..100)  # disabled
number_slider_4 = Slider(10.27, range=0..100)  # disabled
number_slider_5 = Slider(2.91, range=0..100)  # disabled
# PARAMETRIC
uncertainty_principle = Script(
    seatWidth=Slider(10.27, range=0..100),
    seatDepth=Slider(14.31, range=0..100),
    seatHeight=Slider(2.02, range=0..100),
    backHeight=Slider(10.27, range=0..100),
    legThickness=Slider(2.91, range=0..100))  # -> out, Chair; inputs seatWidth: Double, seatDepth: Double, seatHeight: Double, backHeight: Double, legThickness: Double
# ---------- uncertainty_principle: C# ----------
// Grasshopper Script Instance
using System;
using System.Collections;
using System.Collections.Generic;
using System.Drawing;

using Rhino;
using Rhino.Geometry;

using Grasshopper;
using Grasshopper.Kernel;
using Grasshopper.Kernel.Data;
using Grasshopper.Kernel.Types;

//Grasshopper Script Instance
//#! csharp
using System;
using System.Collections.Generic;
using Rhino.Geometry;

public class Script_Instance : GH_ScriptInstance
{
  private void RunScript(
	double seatWidth,
	double seatDepth,
	double seatHeight,
	double backHeight,
	double legThickness,
	out object Chair)
  {
    // Initialize the list to hold all the parts of the chair
    var chairParts = new List<Brep>();

    // Create the seat
    var seat = Brep.CreateFromBox(new Box(Plane.WorldXY, new Interval(0, seatWidth), new Interval(0, seatDepth), new Interval(0, seatHeight)));
    chairParts.Add(seat);

    // Create the back
    var back = Brep.CreateFromBox(new Box(new Plane(new Point3d(0, seatDepth, seatHeight), Vector3d.YAxis, Vector3d.ZAxis), new Interval(0, legThickness), new Interval(0, seatWidth), new Interval(0, backHeight)));
    chairParts.Add(back);

    // Create the four legs
    Point3d[] legCorners = {
      new Point3d(0, 0, 0),
      new Point3d(seatWidth - legThickness, 0, 0),
      new Point3d(seatWidth - legThickness, legThickness, 0),
      new Point3d(0, legThickness, 0),
      new Point3d(0, 0, -seatHeight),
      new Point3d(seatWidth - legThickness, 0, -seatHeight),
      new Point3d(seatWidth - legThickness, legThickness, -seatHeight),
      new Point3d(0, legThickness, -seatHeight)
    };

    foreach (Point3d corner in legCorners)
    {
      var leg = Brep.CreateFromBox(new Box(Plane.WorldXY, new Interval(corner.X, corner.X + legThickness), new Interval(corner.Y, corner.Y + legThickness), new Interval(corner.Z, corner.Z + seatHeight)));
      chairParts.Add(leg);
    }

    // Join all parts into a single Brep
    Chair = Brep.JoinBreps(chairParts, 0.01);
  }
}
# ---------- end uncertainty_principle ----------
# Uncertainty Principle
# HARD CODED
uncertainty_principle_2 = Script(
    seatWidth=number_slider,
    seatDepth=number_slider_2,
    seatHeight=number_slider_3,
    backHeight=number_slider_4,
    legThickness=number_slider_5)  # -> out, Chair; inputs seatWidth: Double, seatDepth: Double, seatHeight: Double, backHeight: Double, legThickness: Double; disabled; same code as uncertainty_principle
panel = Panel(uncertainty_principle.Chair)
panel_2 = Panel(uncertainty_principle.out)
panel_3 = Panel(uncertainty_principle_2.out)  # disabled
panel_4 = Panel(uncertainty_principle_2.Chair)  # disabled
